# Grasshopper definition 260925_rhino_unity.gh (Grasshopper 1.0.8)

# ----
# Debugging
# Convex Hull 3D mesh
deconstruct_mesh = DeconstructMesh()  # -> Vertices, Faces, Colours, Normals
convex_hull_3d = ConvexHull3D(Points=deconstruct_mesh.Vertices)  # -> Hull, Indices
mesh = Mesh(convex_hull_3d.Hull)

# ----
# Normals Visuzalization
face_normals = FaceNormals()  # -> Centers, Normals
vector_display = VectorDisplay(Anchor=face_normals.Centers, Vector=face_normals.Normals)

# ----
# Step 2. Send!
send_to_unity = Button()

# ----
# Step 1. Set Geometry from Rhino
# 1. Create or import your geometry (fbx, obj)
# 2. Select the geometries to send to XR in Rhino
# 3. Select "Set multiple geometries" here
rhino_geometry = Geometry(<brep referenced from the Rhino model>)

qr_frame = Plane(PlaneXY(-0.075, -0.075, 0))
qr_id = Panel("0")

# ----
# Inspect Geometry
inspect_geometry = Python3Script(geo=rhino_geometry)  # -> report
# ---------- inspect_geometry: Python ----------
#! python 3
# venv: venv-compas-xr2

"""Inspect one suspect object.

Drop a new Python 3 script component next to the payload builder, give it a
single input named `geo` (Item Access, type hint: object) and one output
named `report`. Wire the object that keeps turning into a mesh.

Panel the `report` output and read it. For an open cylinder you should see
3 edges (two circles and a seam) and a circle at both ends of one isocurve
direction. A cone shows 2 edges, one circle, and one isocurve end whose
length is ~0 - that is the apex.
"""

import Rhino.Geometry as rg
import scriptcontext as sc
from System import Guid


def run_script(geo):
    tol = sc.doc.ModelAbsoluteTolerance if sc.doc else 1e-3
    lines = ["tolerance={:.6g}".format(tol)]

    obj = geo
    if hasattr(obj, "Value"):
        obj = obj.Value
    if isinstance(obj, Guid) and sc.doc:
        rhobj = sc.doc.Objects.FindId(obj)
        obj = rhobj.Geometry if rhobj else None

    lines.append("type: {}".format(type(obj).__name__))
    if obj is None:
        return "\n".join(lines)

    if isinstance(obj, rg.Brep):
        brep = obj
    elif isinstance(obj, (rg.Surface, rg.Extrusion)):
        brep = obj.ToBrep()
    else:
        lines.append("not surface-like")
        return "\n".join(lines)

    lines.append(
        "faces={} edges={} solid={}".format(
            brep.Faces.Count, brep.Edges.Count, brep.IsSolid
        )
    )

    for i in range(brep.Edges.Count):
        edge = brep.Edges[i]
        try:
            is_circle, circle = edge.TryGetCircle(tol)
        except Exception:
            is_circle, circle = False, None
        lines.append(
            "  edge {}: length={:.6g} circle={}{} linear={}".format(
                i,
                edge.GetLength(),
                is_circle,
                " r={:.6g}".format(circle.Radius) if is_circle else "",
                edge.IsLinear(tol),
            )
        )

    face = brep.Faces[0]
    try:
        srf = face.UnderlyingSurface()
    except Exception:
        lines.append("no underlying surface")
        return "\n".join(lines)

    lines.append(
        "surface={} closed_u={} closed_v={} trimmed_face={}".format(
            type(srf).__name__,
            srf.IsClosed(0),
            srf.IsClosed(1),
            not face.IsSurface,
        )
    )

    for direction in (0, 1):
        domain = srf.Domain(direction)
        for value, label in ((domain.Min, "min"), (domain.Max, "max")):
            try:
                curve = srf.IsoCurve(direction, value)
            except Exception as e:
                lines.append("  iso dir={} {}: failed ({})".format(direction, label, e))
                continue
            if curve is None:
                lines.append("  iso dir={} {}: none".format(direction, label))
                continue
            try:
                is_circle, circle = curve.TryGetCircle(tol)
            except Exception:
                is_circle, circle = False, None
            lines.append(
                "  iso dir={} {}: length={:.6g} circle={}{}".format(
                    direction,
                    label,
                    curve.GetLength(),
                    is_circle,
                    " r={:.6g}".format(circle.Radius) if is_circle else "",
                )
            )

    return "\n".join(lines)


report = run_script(geo)
# ---------- end inspect_geometry ----------
panel = Panel(inspect_geometry)

# ----
# Pipeline
# Convert the geometry into data (compas)
geometry_payload_prep = Python3Script(geometry=rhino_geometry)  # -> payload, summary; inputs geometry: list
# ---------- geometry_payload_prep: Python ----------
#! python 3
# venv: venv-compas-xr2
# r: compas==2.0.4, compas_eve==2.3.0, compas_pb==1.0.0

"""Convert mixed Rhino geometry into a COMPAS payload.

Geometry in, COMPAS JSON string out. Nothing is scaled, written to disk, or
sent anywhere - units are handled upstream by the Normalize Units component,
so whatever arrives here is already in the target unit.

Component inputs
    geometry   List Access, type hint: object

The `list[object]` annotation is what sets List Access. Without it the
component solves once per item and emits one payload per object. Flatten the
input as well, or you get one payload per branch.

Dispatch
    Point3d / Point / PointCloud ....... points
    Mesh / SubD ........................ meshes
    Box / BoundingBox .................. boxes
    Brep / Surface / Extrusion ......... box, sphere or cylinder if it passes
                                         the tests below, otherwise a mesh
    anything else ...................... skipped, listed in `summary`

Primitives are matched as whole solids, never a single face: a filleted box
has a spherical corner face and is still not a sphere.

    sphere     closed solid, exactly 1 spherical face
    cylinder   one cylindrical wall face, either alone (an open tube, when
               ACCEPT_UNCAPPED is on) or as the single curved face of a
               closed 3-face solid whose two planar caps sit perpendicular to
               the axis, spaced by exactly the cylinder height
    box        closed solid, exactly 6 planar faces whose normals resolve to
               exactly 3 mutually perpendicular axes (so a frustum, a wedge
               and a parallelepiped are all rejected)

Anything else is tessellated. Nothing is approximated into a primitive it is
not - there is no bounding-box fallback, so a cone or a bevelled solid comes
through as a mesh rather than as the shape it nearly resembles.

Two independent ways to find the cylinder, in order:

    analytic   TryGetFiniteCylinder / TryGetCylinder on the face and on its
               underlying surface. Fitting a BrepFace directly fails on some
               builds where the underlying surface succeeds, and an infinite
               result gets its height rebuilt from the surface corners.
    edges      two equal-radius coaxial circular edges, which give radius,
               axis and height with no surface fitting at all.

The edge route is not redundant. It covers geometry that is shaped like a
cylinder but no longer analytically is one - a rebuilt surface, or an import
that only carried control points - which the fit rejects. It is also the
looser of the two, since two matching circles do not prove the surface
between them is cylindrical; set CYLINDER_FROM_EDGES to False for a strict
analytic-only match.

`payload` leaves as a COMPAS JSON *string*, not a dict. Rhino 8 marshals a
returned Python dict into a System.Collections.Generic.Dictionary on the way
out of the component, which strips it of both its dict-ness and its COMPAS
objects. A string crosses the boundary untouched and survives the two
components running in different venvs. The receiving end calls
compas.data.json_loads.

Keys match the file-based flow, so a message published from here is
interchangeable with a dumped JSON file:

    boxes  cylinders  meshes  spheres  points  radius  height  compas_version

`radius` and `height` are reported, not supplied: they describe the first
cylinder found (or the first sphere, for radius alone) and are None when the
payload holds neither. Each shape carries its own dimensions.
"""

import Rhino.Geometry as rg
import scriptcontext as sc
from System import Guid

import compas
from compas.data import json_dumps
from compas.geometry import Cylinder
from compas.geometry import Sphere
from compas_rhino.conversions import box_to_compas
from compas_rhino.conversions import mesh_to_compas
from compas_rhino.conversions import plane_to_compas_frame
from compas_rhino.conversions import point_to_compas

# Explain in `summary` how each primitive was matched, and why anything
# surface-like was meshed instead. Switch on when something misbehaves.
DIAGNOSTICS = False

# Accept an open cylindrical tube. Grasshopper's Cylinder primitive and
# _Cylinder with Solid=No both produce one. COMPAS cylinders are solids, so
# turn this off if an open tube must stay a mesh.
ACCEPT_UNCAPPED = True

# Allow the edge-based cylinder route. Off means analytic matching only.
CYLINDER_FROM_EDGES = True

# How far off parallel a direction may be, as a dot product. 1e-4 is roughly
# 0.006 degrees.
ANGLE_EPS = 1e-4


def tolerance():
    return sc.doc.ModelAbsoluteTolerance if sc.doc else 1e-3


def fit_tolerances():
    """Model tolerance, then a looser pass for NURBS approximations."""
    tol = tolerance()
    return (tol, tol * 10.0)


# ---------------------------------------------------------------------------
# input handling
# ---------------------------------------------------------------------------

def ensure_list(value):
    """Normalise a value arriving as None, a single item, or a sequence.

    Strings are single items, not sequences of characters - without that
    guard "cm" would come back as ["c", "m"].
    """
    if value is None:
        return []
    if isinstance(value, str):
        return [value]
    try:
        return [item for item in value if item is not None]
    except TypeError:
        return [value]


def guid_to_geometry(gid):
    rhobj = sc.doc.Objects.FindId(gid) if sc.doc else None
    return rhobj.Geometry if rhobj else None


def unwrap_geometry(obj):
    """Resolve GH wrappers, Rhino 8 model objects and GUIDs to RhinoCommon."""
    if obj is None:
        return None
    if isinstance(obj, Guid):
        return guid_to_geometry(obj)
    # GH goo wrappers (GH_Brep, GH_Mesh, GH_Point...) carry the real geometry
    # on .Value. GH_Guid unwraps to a Guid, so recurse rather than return.
    if hasattr(obj, "Value") and not isinstance(obj, (str, int, float)):
        return unwrap_geometry(obj.Value)
    if hasattr(obj, "Geometry") and obj.Geometry is not None:
        return obj.Geometry
    if hasattr(obj, "ObjectId"):
        return guid_to_geometry(obj.ObjectId)
    # Rhino 8 "Model Object" params hand over a wrapper keyed by document id.
    if hasattr(obj, "Id") and isinstance(getattr(obj, "Id"), Guid):
        resolved = guid_to_geometry(obj.Id)
        if resolved is not None:
            return resolved
    return obj


def as_brep(geo):
    """Anything surface-like, as a Brep. None if it is not surface-like."""
    if isinstance(geo, rg.Brep):
        return geo
    if isinstance(geo, (rg.Extrusion, rg.Surface)):
        return geo.ToBrep()
    return None


# ---------------------------------------------------------------------------
# geometry helpers
# ---------------------------------------------------------------------------

def dot(a, b):
    """Explicit dot product - operator overloads vary between hosts."""
    return a.X * b.X + a.Y * b.Y + a.Z * b.Z


def unit(vector):
    u = rg.Vector3d(vector)
    u.Unitize()
    return u


def parallel(a, b):
    return abs(dot(unit(a), unit(b))) > 1.0 - ANGLE_EPS


def face_plane(face):
    ok, plane = face.TryGetPlane(tolerance())
    return plane if ok else None


def surfaces_of(face):
    """The face and its underlying surface, for analytic fitting.

    Fitting a BrepFace directly fails on some builds where the same call on
    the underlying surface succeeds.
    """
    surfaces = [face]
    try:
        srf = face.UnderlyingSurface()
        if srf is not None:
            surfaces.append(srf)
    except Exception:
        pass
    return surfaces


def try_get(srf, name, tol):
    """Call a TryGetX overload, with and without a tolerance argument."""
    method = getattr(srf, name, None)
    if method is None:
        return None
    for args in ((tol,), ()):
        try:
            ok, result = method(*args)
        except Exception:
            continue
        if ok and result is not None:
            return result
    return None


# ---------------------------------------------------------------------------
# finding a cylinder
# ---------------------------------------------------------------------------

def analytic_cylinder(face):
    """Ask the host whether this face is a cylinder."""
    for srf in surfaces_of(face):
        for tol in fit_tolerances():
            cylinder = try_get(srf, "TryGetFiniteCylinder", tol)
            if cylinder is not None and cylinder.IsFinite:
                return cylinder
            cylinder = try_get(srf, "TryGetCylinder", tol)
            if cylinder is not None:
                return finite(cylinder, face)
    return None


def finite(cylinder, face):
    """An infinite cylinder carries axis and radius but no height."""
    if cylinder.IsFinite:
        return cylinder

    axis = unit(cylinder.Axis)
    origin = cylinder.Center
    for srf in surfaces_of(face):
        try:
            u = srf.Domain(0)
            v = srf.Domain(1)
            corners = [
                srf.PointAt(u.Min, v.Min),
                srf.PointAt(u.Min, v.Max),
                srf.PointAt(u.Max, v.Min),
                srf.PointAt(u.Max, v.Max),
            ]
        except Exception:
            continue
        values = [dot(corner - origin, axis) for corner in corners]
        low, high = min(values), max(values)
        if high - low <= tolerance():
            return None
        base = rg.Plane(origin + axis * low, axis)
        return rg.Cylinder(rg.Circle(base, cylinder.Radius), high - low)
    return None


def edge_circles(brep):
    """Every full circle among the Brep's edges."""
    circles = []
    for i in range(brep.Edges.Count):
        edge = brep.Edges[i]
        for tol in fit_tolerances():
            try:
                ok, circle = edge.TryGetCircle(tol)
            except Exception:
                break
            if ok and circle is not None and circle.IsValid:
                circles.append(circle)
                break
    return circles


def edge_cylinder(brep):
    """Two equal-radius coaxial circular edges define a cylinder outright.

    No surface fitting, so this catches geometry that is shaped like a
    cylinder without analytically being one.
    """
    circles = edge_circles(brep)
    if len(circles) != 2:
        return None

    tol = tolerance()
    first, second = circles
    if abs(first.Radius - second.Radius) > tol:
        return None
    if not parallel(first.Normal, second.Normal):
        return None

    offset = second.Center - first.Center
    height = offset.Length
    if height <= tol:
        return None
    # The centres must be offset along the normal, not sideways.
    if not parallel(offset, first.Normal):
        return None

    base = rg.Plane(first.Center, unit(offset))
    return rg.Cylinder(rg.Circle(base, first.Radius), height)


def find_cylinder(brep, face):
    """(cylinder, route). Analytic first, then edges."""
    cylinder = analytic_cylinder(face)
    if cylinder is not None:
        return cylinder, "analytic"
    if CYLINDER_FROM_EDGES:
        cylinder = edge_cylinder(brep)
        if cylinder is not None:
            return cylinder, "edges"
    return None, None


def full_revolution(brep, face):
    """A whole tube, not a trimmed patch of one."""
    try:
        srf = face.UnderlyingSurface()
        if srf.IsClosed(0) or srf.IsClosed(1):
            return True
    except Exception:
        pass
    return len(edge_circles(brep)) == 2


def describe(brep, face):
    """Surface type and closure, for a failed cylinder match."""
    name = "?"
    closure = "?"
    try:
        srf = face.UnderlyingSurface()
        name = type(srf).__name__
        closure = "closed(u)={} closed(v)={}".format(srf.IsClosed(0), srf.IsClosed(1))
    except Exception:
        pass
    return "surface={} {} circular_edges={} total_edges={}".format(
        name, closure, len(edge_circles(brep)), brep.Edges.Count
    )


# ---------------------------------------------------------------------------
# matching
#
# Each match returns (shape or None, reason). The reason explains the match or
# the rejection, and shows up in `summary` when DIAGNOSTICS is on.
# ---------------------------------------------------------------------------

def match_sphere(brep):
    if not brep.IsSolid:
        return None, "not a closed solid"
    if brep.Faces.Count != 1:
        return None, "{} faces, a sphere has 1".format(brep.Faces.Count)

    for srf in surfaces_of(brep.Faces[0]):
        for tol in fit_tolerances():
            sphere = try_get(srf, "TryGetSphere", tol)
            if sphere is not None:
                return sphere, "sphere r={:.4g}".format(sphere.Radius)
    return None, "the single face is not spherical"


def cylinder_parts(brep):
    """(wall face, cap faces, reason). Wall is None when the shape is wrong."""
    count = brep.Faces.Count

    if count == 1:
        if not ACCEPT_UNCAPPED:
            return None, None, "1 face, a capped cylinder has 3 (ACCEPT_UNCAPPED off)"
        return brep.Faces[0], [], None

    if count != 3:
        return None, None, "{} faces, a capped cylinder has 3".format(count)
    if not brep.IsSolid:
        return None, None, "3 faces but not a closed solid"

    tol = tolerance()
    caps = []
    walls = []
    for i in range(count):
        face = brep.Faces[i]
        (caps if face.IsPlanar(tol) else walls).append(face)

    if len(caps) != 2 or len(walls) != 1:
        return None, None, "{} planar + {} curved faces, expected 2 + 1".format(
            len(caps), len(walls)
        )
    return walls[0], caps, None


def caps_fit(caps, cylinder):
    """Caps must sit square to the axis, exactly one height apart."""
    axis = unit(cylinder.Axis)
    planes = []
    for face in caps:
        plane = face_plane(face)
        if plane is None:
            return "a cap face has no plane"
        if not parallel(plane.Normal, axis):
            return "a cap is not perpendicular to the axis"
        planes.append(plane)

    height = abs(cylinder.Height2 - cylinder.Height1)
    span = abs(dot(planes[1].Origin - planes[0].Origin, axis))
    if abs(span - height) > max(tolerance(), 1e-9):
        return "cap spacing {:.4g} != cylinder height {:.4g}".format(span, height)
    return None


def match_cylinder(brep):
    wall, caps, reason = cylinder_parts(brep)
    if wall is None:
        return None, reason

    cylinder, route = find_cylinder(brep, wall)
    if cylinder is None:
        return None, "the wall face is not a cylinder ({})".format(describe(brep, wall))

    if caps:
        problem = caps_fit(caps, cylinder)
        if problem:
            return None, problem
    elif not full_revolution(brep, wall):
        return None, "the wall face is only a partial revolution"

    height = abs(cylinder.Height2 - cylinder.Height1)
    return cylinder, "cylinder via {} r={:.4g} h={:.4g}".format(
        route, cylinder.Radius, height
    )


def match_box(brep):
    if not brep.IsSolid:
        return None, "not a closed solid"
    if brep.Faces.Count != 6:
        return None, "{} faces, a box has 6".format(brep.Faces.Count)

    normals = []
    for i in range(brep.Faces.Count):
        plane = face_plane(brep.Faces[i])
        if plane is None:
            return None, "face {} is not planar".format(i)
        normals.append(unit(plane.Normal))

    # Every normal must be parallel to an axis already seen, or perpendicular
    # to all of them. Anything in between means the solid is not a box.
    axes = []
    for normal in normals:
        aligned = False
        for axis in axes:
            d = abs(dot(axis, normal))
            if d > 1.0 - ANGLE_EPS:
                aligned = True
                break
            if d > ANGLE_EPS:
                return None, "faces are not mutually parallel/perpendicular"
        if not aligned:
            axes.append(normal)

    if len(axes) != 3:
        return None, "normals resolve to {} axes, a box has 3".format(len(axes))

    plane = rg.Plane(rg.Point3d.Origin, axes[0], axes[1])
    if not plane.IsValid:
        return None, "could not build a frame from the face normals"

    # In this frame the solid is axis-aligned, so its bounding box is the box.
    try:
        bbox = brep.GetBoundingBox(plane)
    except Exception as e:
        return None, "bounding box failed: {}".format(e)
    if not bbox.IsValid:
        return None, "bounding box is invalid"

    box = rg.Box(
        plane,
        rg.Interval(bbox.Min.X, bbox.Max.X),
        rg.Interval(bbox.Min.Y, bbox.Max.Y),
        rg.Interval(bbox.Min.Z, bbox.Max.Z),
    )
    if not box.IsValid:
        return None, "box is invalid"
    return box, "box"


def tessellate(brep):
    """Mesh a Brep into a single joined rg.Mesh."""
    pieces = rg.Mesh.CreateFromBrep(brep, rg.MeshingParameters.Default)
    if not pieces:
        return None

    joined = rg.Mesh()
    for piece in pieces:
        joined.Append(piece)
    joined.Compact()
    return joined


# ---------------------------------------------------------------------------
# COMPAS conversion
# ---------------------------------------------------------------------------

def to_compas_sphere(sphere):
    """A sphere has no meaningful orientation, so a world-aligned frame."""
    plane = rg.Plane.WorldXY
    plane.Origin = sphere.Center
    return Sphere(sphere.Radius, frame=plane_to_compas_frame(plane))


def to_compas_cylinder(cylinder):
    """COMPAS puts the cylinder frame at mid-height, Rhino at the base."""
    height = abs(cylinder.Height2 - cylinder.Height1)
    mid = (cylinder.Height1 + cylinder.Height2) / 2.0
    plane = cylinder.CircleAt(mid).Plane
    return Cylinder(cylinder.Radius, height, frame=plane_to_compas_frame(plane))


# ---------------------------------------------------------------------------
# dispatch
# ---------------------------------------------------------------------------

def sort_into(geo, buckets, notes):
    """Put one piece of RhinoCommon geometry in a bucket.

    Raises TypeError with a message that ends up in `summary` when the
    geometry cannot be handled at all.
    """
    if isinstance(geo, rg.Point3d):
        buckets["points"].append(point_to_compas(geo))
        return

    if isinstance(geo, rg.Point):
        buckets["points"].append(point_to_compas(geo.Location))
        return

    if isinstance(geo, rg.PointCloud):
        for item in geo:
            buckets["points"].append(point_to_compas(item.Location))
        return

    if isinstance(geo, rg.Mesh):
        buckets["meshes"].append(mesh_to_compas(geo))
        return

    if isinstance(geo, rg.Box):
        buckets["boxes"].append(box_to_compas(geo))
        return

    if isinstance(geo, rg.BoundingBox):
        buckets["boxes"].append(box_to_compas(rg.Box(geo)))
        return

    if hasattr(rg, "SubD") and isinstance(geo, rg.SubD):
        mesh = tessellate(geo.ToBrep())
        if mesh is None:
            raise TypeError("SubD could not be tessellated.")
        buckets["meshes"].append(mesh_to_compas(mesh))
        return

    brep = as_brep(geo)
    if brep is None:
        raise TypeError("unsupported type {}.".format(type(geo).__name__))

    sphere, why_sphere = match_sphere(brep)
    if sphere is not None:
        buckets["spheres"].append(to_compas_sphere(sphere))
        notes.append("matched {}".format(why_sphere))
        return

    cylinder, why_cylinder = match_cylinder(brep)
    if cylinder is not None:
        buckets["cylinders"].append(to_compas_cylinder(cylinder))
        notes.append("matched {}".format(why_cylinder))
        return

    box, why_box = match_box(brep)
    if box is not None:
        buckets["boxes"].append(box_to_compas(box))
        notes.append("matched {}".format(why_box))
        return

    mesh = tessellate(brep)
    if mesh is None:
        raise TypeError("{} could not be tessellated.".format(type(geo).__name__))
    buckets["meshes"].append(mesh_to_compas(mesh))
    notes.append(
        "{} ({} faces, solid={}) -> mesh | sphere: {} | cylinder: {} | box: {}".format(
            type(geo).__name__,
            brep.Faces.Count,
            brep.IsSolid,
            why_sphere,
            why_cylinder,
            why_box,
        )
    )


def run_script(geometry: list[object]):

    try:
        buckets = {
            "boxes": [],
            "cylinders": [],
            "meshes": [],
            "spheres": [],
            "points": [],
        }
        skipped = []
        reports = []

        for index, item in enumerate(ensure_list(geometry)):
            geo = unwrap_geometry(item)
            if geo is None:
                skipped.append("[{}] could not be resolved".format(index))
                continue
            notes = []
            try:
                sort_into(geo, buckets, notes)
            except TypeError as e:
                skipped.append("[{}] {}".format(index, e))
            for note in notes:
                reports.append("[{}] {}".format(index, note))

        # Reported, not supplied. Each shape carries its own dimensions.
        radius = None
        height = None
        if buckets["cylinders"]:
            radius = buckets["cylinders"][0].radius
            height = buckets["cylinders"][0].height
        elif buckets["spheres"]:
            radius = buckets["spheres"][0].radius

        compas_data = {
            "boxes": buckets["boxes"],
            "cylinders": buckets["cylinders"],
            "meshes": buckets["meshes"],
            "spheres": buckets["spheres"],
            "points": buckets["points"],
            "radius": radius,
            "height": height,
            "compas_version": compas.__version__,
        }

        summary = "boxes={} cylinders={} meshes={} spheres={} points={}".format(
            len(buckets["boxes"]),
            len(buckets["cylinders"]),
            len(buckets["meshes"]),
            len(buckets["spheres"]),
            len(buckets["points"]),
        )
        if skipped:
            summary += "\nskipped {}:\n  {}".format(len(skipped), "\n  ".join(skipped))
        if DIAGNOSTICS and reports:
            summary += "\n" + "\n".join(reports)

        return json_dumps(compas_data), summary

    except Exception as e:
        return None, "Payload build failed: {}: {}".format(type(e).__name__, e)


(payload, summary) = run_script(geometry)
# ---------- end geometry_payload_prep ----------
panel_2 = Panel(geometry_payload_prep.summary)

# ----
# Convert units to meters
panel_3 = Panel("m")
convert_to_meters = Python3Script(payload=geometry_payload_prep.payload, to_unit=panel_3)  # -> normalized, factor, ok, report
# ---------- convert_to_meters: Python ----------
#! python 3
# venv: venv-compas-xr2
# r: compas==2.0.4, compas_eve==2.3.0, compas_pb==1.0.0

"""Rescale a COMPAS payload into a target unit.

Purely a data step. Nothing on the canvas moves and no Rhino geometry is
touched - the model stays drawn at whatever size you drew it, and only the
numbers inside the payload are converted. Drop this between the COMPAS
Geometry Payload component and whatever consumes the payload.

It exists because COMPAS carries no unit metadata. A Box with xsize=40 is
just 40, and the consumer on the far end of MQTT cannot tell whether that
meant 40 cm or 40 m. Converting here means the message is unambiguously in
the target unit while the Grasshopper definition stays in document units.

The payload input accepts three shapes, because Rhino 8 marshals a returned
Python dict into a .NET Dictionary and Grasshopper may then spread that
across the wire as one key-value pair per item:

  - a COMPAS JSON string (one item),
  - a dict or .NET Dictionary (one item),
  - N key-value pairs (the flattened form, e.g. {0;0} N=8).

All three are folded back into a plain dict before scaling. The output is a
COMPAS JSON string, which crosses the next component boundary intact.

Leaving from_unit unwired makes the source unit the Rhino document unit, so
the common case is: wire the payload, set to_unit to "m", done. If source
and target match the factor is 1.0 and nothing changes.

Scaling is per type rather than one blanket transform, because the pieces of
a shape scale differently: a Box scales in its sizes and frame origin, a
Cylinder in radius, height and origin, a Sphere in radius and origin, a Point
in its coordinates, and a Mesh in its vertices. A frame's axes are direction
vectors and are deliberately left alone - scaling them would corrupt the
orientation.

run_script is defined directly below the imports, before the helpers it
calls. Python resolves those names at call time, so the ordering is legal.
"""

import Rhino
import scriptcontext as sc
from Rhino import RhinoMath
from Rhino import UnitSystem

from compas.data import json_dumps
from compas.data import json_loads
from compas.datastructures import Mesh
from compas.geometry import Box
from compas.geometry import Cylinder
from compas.geometry import Point
from compas.geometry import Scale
from compas.geometry import Sphere

# Top-level payload keys holding geometry, in report order.
GEOMETRY_KEYS = ("boxes", "cylinders", "meshes", "spheres", "points")

# Top-level payload keys that are lengths and must scale with the geometry.
SCALAR_KEYS = ("radius", "height")

# Bounds on a plausible model, in metres, used for the sanity check.
SANITY_MIN = 1e-4
SANITY_MAX = 1e4


def run_script(payload, to_unit, from_unit):
    try:
        data = resolve_payload(payload)

        # print(describe(data))  # uncomment to see what actually arrived

        source = resolve_unit(from_unit, document_unit())
        target = resolve_unit(to_unit, UnitSystem.Meters)

        factor = RhinoMath.UnitScale(source, target)
        if factor <= 0:
            raise ValueError("Bad unit scale {} -> {}.".format(source, target))

        xform = Scale.from_factors([factor, factor, factor])

        counts = []
        for key in GEOMETRY_KEYS:
            objects = ensure_list(data.get(key))
            data[key] = [scale_object(o, factor, xform) for o in objects]
            counts.append((key, len(objects)))

        for key in SCALAR_KEYS:
            if data.get(key) is not None:
                data[key] = float(data[key]) * factor

        ok, report = build_report(source, target, factor, counts,
                                  extent_of(data))

        return json_dumps(data), factor, ok, report

    except Exception as e:
        return (None, None, False,
                "Unit conversion failed: {}: {}".format(type(e).__name__, e))


def document_unit():
    """The Rhino document's unit system, with a sane fallback."""
    doc = Rhino.RhinoDoc.ActiveDoc
    if doc is None:
        doc = getattr(sc, "doc", None)
    unit = getattr(doc, "ModelUnitSystem", None)
    return unit if unit is not None else UnitSystem.Meters


def unit_aliases():
    """Rhino unit systems under the spellings people actually type."""
    return {
        "m": UnitSystem.Meters,
        "meter": UnitSystem.Meters,
        "meters": UnitSystem.Meters,
        "metre": UnitSystem.Meters,
        "metres": UnitSystem.Meters,
        "cm": UnitSystem.Centimeters,
        "centimeter": UnitSystem.Centimeters,
        "centimeters": UnitSystem.Centimeters,
        "mm": UnitSystem.Millimeters,
        "millimeter": UnitSystem.Millimeters,
        "millimeters": UnitSystem.Millimeters,
        "in": UnitSystem.Inches,
        "inch": UnitSystem.Inches,
        "inches": UnitSystem.Inches,
        "ft": UnitSystem.Feet,
        "foot": UnitSystem.Feet,
        "feet": UnitSystem.Feet,
    }


def ensure_list(value):
    """Normalise a value arriving as None, a single item, or a sequence.

    Strings are single items, not sequences of characters - without that
    guard "cm" would come back as ["c", "m"].
    """
    if value is None:
        return []
    if isinstance(value, str):
        return [value]
    try:
        return [item for item in value if item is not None]
    except TypeError:
        return [value]


def unwrap(obj):
    """Strip Grasshopper's object wrapper, if there is one."""
    return getattr(obj, "Value", obj)


def unwrap_many(value):
    """Unwrap a payload value: a sequence of objects, or a plain scalar."""
    if value is None or isinstance(value, (str, int, float, bool)):
        return value
    inner = unwrap(value)
    if inner is not value:
        return unwrap_many(inner)
    try:
        return [unwrap(item) for item in value]
    except TypeError:
        return value


def as_mapping(obj):
    """Return obj as a plain dict if it looks like a mapping, else None."""
    if isinstance(obj, dict):
        return dict(obj)
    keys = getattr(obj, "Keys", None)
    if keys is None:
        return None
    try:
        return {str(key): obj[key] for key in keys}
    except Exception:
        return None


def resolve_unit(value, fallback):
    """Turn a unit input into a Rhino UnitSystem, falling back when empty."""
    items = ensure_list(value)
    if not items:
        return fallback
    text = str(unwrap(items[0])).strip().lower()
    if not text:
        return fallback
    aliases = unit_aliases()
    if text not in aliases:
        raise ValueError(
            "Unknown unit {!r}. Use one of: {}.".format(
                text, ", ".join(sorted(set(aliases)))
            )
        )
    return aliases[text]


def resolve_payload(value):
    """Turn the payload input into the dict of COMPAS objects to rescale."""
    items = ensure_list(value)
    if not items:
        raise ValueError("payload is required.")

    if len(items) == 1:
        item = unwrap(items[0])

        if isinstance(item, str):
            decoded = json_loads(item)
            if not isinstance(decoded, dict):
                raise TypeError(
                    "payload must decode to a dict, got {}.".format(
                        type(decoded).__name__
                    )
                )
            return decoded

        mapping = as_mapping(item)
        if mapping is None:
            raise TypeError(
                "payload must be a COMPAS JSON string or a dict, got {}. "
                "Wire the payload output of the COMPAS Geometry Payload "
                "component.".format(type(item).__name__)
            )
        return {str(k): unwrap_many(v) for k, v in mapping.items()}

    # Several items: a dict that Grasshopper flattened into key-value pairs.
    decoded = {}
    for position, item in enumerate(items, start=1):
        entry = unwrap(item)
        key = getattr(entry, "Key", None)
        if key is None:
            raise TypeError(
                "payload arrived as {} items and item {} is a {}, not a "
                "key-value pair. Either wire a single payload, or have the "
                "upstream component return json_dumps(data).".format(
                    len(items), position, type(entry).__name__
                )
            )
        decoded[str(key)] = unwrap_many(entry.Value)
    return decoded


def move_origin(frame, factor):
    """Scale a frame's origin in place, leaving its axes as unit directions."""
    point = frame.point
    point.x *= factor
    point.y *= factor
    point.z *= factor


def scale_object(obj, factor, xform):
    """Rescale one COMPAS object in place and return it."""
    obj = unwrap(obj)

    if isinstance(obj, Box):
        obj.xsize *= factor
        obj.ysize *= factor
        obj.zsize *= factor
        move_origin(obj.frame, factor)
        return obj

    if isinstance(obj, Cylinder):
        obj.radius *= factor
        obj.height *= factor
        move_origin(obj.frame, factor)
        return obj

    if isinstance(obj, Sphere):
        obj.radius *= factor
        move_origin(obj.frame, factor)
        return obj

    if isinstance(obj, Point):
        obj.x *= factor
        obj.y *= factor
        obj.z *= factor
        return obj

    if isinstance(obj, Mesh):
        obj.transform(xform)
        return obj

    raise TypeError(
        "Do not know how to rescale {}. If this is a .NET type rather than a "
        "COMPAS one, the objects were stripped in transit and the upstream "
        "component needs to return json_dumps(data).".format(type(obj).__name__)
    )


def extent_of(data):
    """Largest absolute coordinate in the payload, for the sanity check."""
    values = []

    for obj in ensure_list(data.get("boxes")):
        values += [obj.xsize, obj.ysize, obj.zsize,
                   obj.frame.point.x, obj.frame.point.y, obj.frame.point.z]
    for obj in ensure_list(data.get("cylinders")):
        values += [obj.radius, obj.height,
                   obj.frame.point.x, obj.frame.point.y, obj.frame.point.z]
    for obj in ensure_list(data.get("spheres")):
        values += [obj.radius,
                   obj.frame.point.x, obj.frame.point.y, obj.frame.point.z]
    for obj in ensure_list(data.get("points")):
        values += [obj.x, obj.y, obj.z]
    for mesh in ensure_list(data.get("meshes")):
        for key in mesh.vertices():
            values += list(mesh.vertex_coordinates(key))

    biggest = max([abs(float(v)) for v in values], default=0.0)
    return biggest if biggest > 0 else None


def describe(data):
    """What actually arrived, for debugging the payload crossing."""
    lines = []
    for key, value in data.items():
        if isinstance(value, list):
            first = type(value[0]).__name__ if value else "-"
            lines.append("{}: list[{}] x{}".format(key, first, len(value)))
        else:
            lines.append("{}: {}".format(key, type(value).__name__))
    return "\n".join(lines)


def build_report(source, target, factor, counts, extent):
    """Human-readable check line, plus an ok flag."""
    lines = [
        "{} -> {}  (x{:g})".format(source, target, factor),
        "  ".join("{}={}".format(key, n) for key, n in counts),
    ]

    ok = True
    if extent is None:
        lines.append("extent: nothing to measure")
    else:
        in_metres = extent * RhinoMath.UnitScale(target, UnitSystem.Meters)
        lines.append("largest value: {:g} {} ({:g} m)".format(
            extent, target, in_metres))
        if not (SANITY_MIN <= in_metres <= SANITY_MAX):
            ok = False
            lines.append(
                "WARNING: {:g} m is outside the plausible range {:g}-{:g} m. "
                "Check the source unit.".format(in_metres, SANITY_MIN, SANITY_MAX)
            )

    if source == target:
        lines.append("NOTE: source and target units match; nothing was scaled.")

    return ok, "\n".join(lines)


(normalized, factor, ok, report) = run_script(payload, to_unit, from_unit)
# ---------- end convert_to_meters ----------
panel_4 = Panel(convert_to_meters.report)

# ----
# CAD - Unity
# Communication
panel_5 = Panel("compasxr/147abhf76tblashrav/to_unity")

latest_only = BooleanToggle(False)
reset = Button()

# ----
# Send Geometry to Unity
dry_run = BooleanToggle(False)
mqtt_publisher = COMPASEveMQTTPublisher(
    all_geometry=convert_to_meters.normalized,
    broker="broker.hivemq.com",
    topic=panel_5,
    codec="proto",
    publish=send_to_unity,
    dry_run=dry_run,
    qr_frames=qr_frame,
    qr_ids=qr_id)  # -> success, payload_out, message; inputs qr_frames: list
# ---------- mqtt_publisher: Python ----------
# r: compas==2.0.4, compas_eve==2.3.0, compas_pb==1.0.0
# venv: venv-compas-xr2

"""Publish a COMPAS all_geometry to an MQTT broker with compas_eve.

Single responsibility: transport. This component builds no geometry and touches
no disk - it takes a ready all_geometry (the `all_geometry` output of the COMPAS Geometry
all_geometry component, or the `compas_data` output of the file writer) and puts it
on a topic.

The transport is cached in `scriptcontext.sticky` and reused across solves.
MqttTransport connects asynchronously and its publish() defers the actual send
through on_ready, so a transport built and closed inside one solve would tear
down its network loop before the message ever left the process.

Codecs mirror compas_geo_publisher.py: 'json' (COMPAS JSON) and 'protobuf'
(compas_pb binary, what the Unity GeometryPublisher side consumes).

qr_frames (optional, list of Planes): added to the message as
"qr_frames": {"7": Frame, ...}. Plane origin = the printed QR's bottom-left corner,
X = red "X Axis" line, Y = green "Y Axis" line.
qr_ids (optional, list of ints): the QR number of each plane (7 -> QR7 / Tracker_07).
Give every student different numbers. Without it, the list index is used (0, 1, ...).
"""

import time

import Grasshopper
import scriptcontext as sc

import compas_eve as eve
from compas_eve.codecs import JsonMessageCodec
from compas_eve.mqtt import MqttTransport
from compas.data import json_dumps
from compas.data import json_loads
from compas_rhino.conversions import plane_to_compas_frame

STICKY_KEY = "compas_eve.mqtt.transports"
CONNECT_TIMEOUT = 5.0
DEFAULT_PORT = 1883


def require_text(value, label):
    text = str(value).strip() if value is not None else ""
    if not text:
        raise ValueError("{} is required.".format(label))
    return text


def build_codec(name):
    """Return (codec, canonical_name) for a codec input string."""
    key = str(name or "json").strip().lower()
    if key == "json":
        return JsonMessageCodec(), "json"
    if key in ("proto", "protobuf"):
        # Imported lazily so a missing compas_pb only breaks the protobuf path.
        from compas_eve.codecs import ProtobufMessageCodec

        return ProtobufMessageCodec(), "protobuf"
    raise ValueError("Unknown codec {!r}. Use 'json' or 'protobuf'.".format(name))


def get_transport(host, port, codec_name, codec):
    """Connected transport for this endpoint, created once and cached."""
    store = sc.sticky.setdefault(STICKY_KEY, {})
    key = (host, port, codec_name)
    transport = store.get(key)

    if transport is not None:
        if transport.client.is_connected():
            return transport
        # The broker dropped us. Discard the stale one before reconnecting.
        try:
            transport.close()
        except Exception:
            pass
        store.pop(key, None)

    transport = MqttTransport(host, port=port, codec=codec)

    deadline = time.time() + CONNECT_TIMEOUT
    while not transport.client.is_connected() and time.time() < deadline:
        time.sleep(0.05)

    if not transport.client.is_connected():
        transport.close()
        raise RuntimeError(
            "No connection to {}:{} within {:.0f}s.".format(host, port, CONNECT_TIMEOUT)
        )

    store[key] = transport
    return transport


def stamped(all_geometry):
    """Copy the all_geometry with a fresh `ts`.

    Unity's MqttManager.Msg setter skips an assignment whose value equals the
    previous one, so republishing unchanged geometry would be swallowed on the
    receiving end. A moving field keeps consecutive messages distinct. Same
    workaround as compas_geo_publisher.stamp_all_geometry_ts.
    """
    if not isinstance(all_geometry, dict):
        return all_geometry
    message = dict(all_geometry)
    message["ts"] = time.time()
    return message


def close_all():
    """Drop every cached transport. Wired to `disconnect`."""
    store = sc.sticky.get(STICKY_KEY) or {}
    count = len(store)
    for transport in list(store.values()):
        try:
            transport.close()
        except Exception:
            pass
    store.clear()
    return count


def run_script(
    all_geometry,
    broker,
    port,
    topic,
    codec,
    retain,
    publish,
    disconnect,
    dry_run,
    qr_frames,
    qr_ids):

    print(type(all_geometry), list(all_geometry.keys()) if isinstance(all_geometry, dict) else all_geometry)

    if disconnect:
        return False, None, "Closed {} cached transport(s).".format(close_all())

    if not publish:
        return False, None, "Press \"Send to Unity\" to send over the Geometry."

    try:
        if all_geometry is None:
            raise ValueError("all_geometry is required.")

        # Check if all_geometry is a list and convert it to a dictionary
        host = require_text(broker, "broker")
        topic_name = require_text(topic, "topic")
        port_number = int(port) if port else DEFAULT_PORT

        codec, codec_name = build_codec(codec)
        transport = get_transport(host, port_number, codec_name, codec)
        time.sleep(0.3)  # temporary — testing a connect/publish race

        publisher = eve.Publisher(eve.Topic(topic_name), transport=transport)

        all_geometry = json_loads(all_geometry)
        if qr_frames:
            ids = qr_ids or range(len(qr_frames))
            all_geometry["qr_frames"] = {str(int(n)): plane_to_compas_frame(p) for n, p in zip(ids, qr_frames)}
        all_geometry = stamped(all_geometry)

        if dry_run:
            return True, all_geometry, "[Dry Run]: This all_geometry would be published to {}:{} on '{}'.".format(
                host, port_number, topic_name)

        # Publish the timestamped all_geometry directly
        publisher.publish(all_geometry)
        return True, all_geometry, "Published {} all_geometry to {}:{} on '{}'.".format(
            codec_name, host, port_number, topic_name
        )

    except Exception as e:
        return False, all_geometry, "Publish failed: {}: {}".format(type(e).__name__, e)

(success, all_geometry_out, message) = run_script(all_geometry, broker, port, topic, codec, retain, publish, disconnect, dry_run, qr_frames, qr_ids)
# ---------- end mqtt_publisher ----------
panel_6 = Panel(mqtt_publisher.message)

document_unit = Python3Script()  # -> unit
# ---------- document_unit: Python ----------
import Rhino
import scriptcontext as sc
from Rhino import UnitSystem

def document_unit():
    """The Rhino document's unit system, with a sane fallback."""
    doc = Rhino.RhinoDoc.ActiveDoc
    if doc is None:
        doc = getattr(sc, "doc", None)
    unit = getattr(doc, "ModelUnitSystem", None)
    return unit if unit is not None else UnitSystem.Meters

unit = document_unit()
# ---------- end document_unit ----------
meters = UnitSystem(4)

# ----
# Get updates from Unity
panel_7 = Panel("compasxr/147abhf76tblafjukh/to_rhino")
subscribe = BooleanToggle(True)
auto_update = BooleanToggle(True)
mqtt_subscriber = Python3Script(
    broker="broker.hivemq.com",
    topic=panel_7,
    codec="proto",
    subscribe=subscribe,
    auto_update=auto_update,
    latest_only=latest_only,
    reset=reset)  # -> success, geometry, data, raw, message
# ---------- mqtt_subscriber: Python ----------
# r: compas==2.0.4, compas_eve==2.3.0, compas_pb==1.0.0
# venv: venv-compas-xr2

"""Receive COMPAS payloads from an MQTT broker and surface them in Grasshopper.

Mirror image of the publisher component. It reuses the *same* cached
MqttTransport (same STICKY_KEY, same key tuple), so publishing and receiving
share one broker connection.

Threading is the whole design constraint here. compas_eve invokes the callback
on the MQTT network thread; Rhino and Grasshopper objects may only be touched
from the UI thread. So the callback does nothing but append the raw message to
a lock-guarded inbox, and Grasshopper reads that inbox during a normal solve.

Subscriptions are cached per (host, port, codec, topic). Subscribing again on
every solve would stack duplicate callbacks and multiply every message.
"""

import threading
import time
from collections import deque

import Rhino
import scriptcontext as sc

import compas_eve as eve
from compas_eve.codecs import JsonMessageCodec
from compas_eve.mqtt import MqttTransport

from compas.data import Data
from compas.data import json_dumps
from compas.data import json_loads

import compas_rhino.conversions as conversions

STICKY_KEY = "compas_eve.mqtt.transports"  # must match the publisher component
SUBS_KEY = "compas_eve.mqtt.subscriptions"
CONNECT_TIMEOUT = 5.0
DEFAULT_PORT = 1883
INBOX_SIZE = 50


# ---------------------------------------------------------------------------
# transport - identical to the publisher so the cache entry is shared
# ---------------------------------------------------------------------------

def require_text(value, label):
    text = str(value).strip() if value is not None else ""
    if not text:
        raise ValueError("{} is required.".format(label))
    return text


def build_codec(name):
    key = str(name or "json").strip().lower()
    if key == "json":
        return JsonMessageCodec(), "json"
    if key in ("proto", "protobuf"):
        from compas_eve.codecs import ProtobufMessageCodec

        return ProtobufMessageCodec(), "protobuf"
    raise ValueError("Unknown codec {!r}. Use 'json' or 'protobuf'.".format(name))


def get_transport(host, port, codec_name, codec):
    store = sc.sticky.setdefault(STICKY_KEY, {})
    key = (host, port, codec_name)
    transport = store.get(key)

    if transport is not None:
        if transport.client.is_connected():
            return transport, key
        try:
            transport.close()
        except Exception:
            pass
        store.pop(key, None)
        drop_subscriptions_for(key)

    transport = MqttTransport(host, port=port, codec=codec)

    deadline = time.time() + CONNECT_TIMEOUT
    while not transport.client.is_connected() and time.time() < deadline:
        time.sleep(0.05)

    if not transport.client.is_connected():
        transport.close()
        raise RuntimeError(
            "No connection to {}:{} within {:.0f}s.".format(host, port, CONNECT_TIMEOUT)
        )

    store[key] = transport
    return transport, key


# ---------------------------------------------------------------------------
# subscription + inbox
# ---------------------------------------------------------------------------

def request_solution(component):
    """Ask Grasshopper to recompute, called from the MQTT thread.

    ExpireSolution has to run on the UI thread, so it is marshalled across with
    InvokeOnUiThread. Failure here is cosmetic: the message is already in the
    inbox and any manual recompute will pick it up.
    """
    if component is None:
        return

    def expire():
        try:
            if component.OnPingDocument() is not None:
                component.ExpireSolution(True)
        except Exception:
            pass

    try:
        import System

        Rhino.RhinoApp.InvokeOnUiThread(System.Action(expire))
    except Exception:
        pass


def ensure_subscription(transport, transport_key, topic_name, component, auto_update):
    """Subscribe once per endpoint+topic and return the inbox for it."""
    store = sc.sticky.setdefault(SUBS_KEY, {})
    sub_key = transport_key + (topic_name,)

    entry = store.get(sub_key)
    if entry is not None:
        entry["component"] = component if auto_update else None
        return entry

    entry = {
        "lock": threading.Lock(),
        "messages": deque(maxlen=INBOX_SIZE),
        "count": 0,
        "component": component if auto_update else None,
        "subscriber": None,
    }

    def on_message(message):
        # MQTT network thread. Do not touch Rhino or Grasshopper from here.
        with entry["lock"]:
            entry["messages"].append(message)
            entry["count"] += 1
        request_solution(entry["component"])

    subscriber = eve.Subscriber(
        eve.Topic(topic_name), callback=on_message, transport=transport
    )
    subscriber.subscribe()

    entry["subscriber"] = subscriber
    store[sub_key] = entry
    return entry


def drop_subscriptions_for(transport_key):
    """Forget subscriptions bound to a transport that has gone away."""
    store = sc.sticky.get(SUBS_KEY) or {}
    for sub_key in [k for k in store if k[: len(transport_key)] == transport_key]:
        entry = store.pop(sub_key)
        try:
            entry["subscriber"].unsubscribe()
        except Exception:
            pass


def unsubscribe_all():
    store = sc.sticky.get(SUBS_KEY) or {}
    count = len(store)
    for entry in list(store.values()):
        try:
            entry["subscriber"].unsubscribe()
        except Exception:
            pass
    store.clear()
    return count


# ---------------------------------------------------------------------------
# payload -> COMPAS -> Rhino
# ---------------------------------------------------------------------------

def rehydrate(message):
    """Rebuild COMPAS objects from a decoded message.

    Depending on the codec you may already get real COMPAS objects back. If you
    get plain dicts carrying `dtype`/`value`, a round trip through the COMPAS
    encoder reconstructs them. Anything that will not round trip is returned
    untouched.
    """
    try:
        return json_loads(json_dumps(message))
    except Exception:
        return message


def collect_data(value, found, depth=0):
    """Walk a nested payload and pull out every COMPAS Data instance."""
    if depth > 8:
        return found
    if isinstance(value, Data):
        found.append(value)
    elif isinstance(value, dict):
        for item in value.values():
            collect_data(item, found, depth + 1)
    elif isinstance(value, (list, tuple)):
        for item in value:
            collect_data(item, found, depth + 1)
    return found


# Ordered because subclasses have to be tested before their bases.
def converter_table():
    from compas.datastructures import Mesh
    from compas.geometry import (
        Box,
        Circle,
        Cone,
        Cylinder,
        Ellipse,
        Frame,
        Line,
        Plane,
        Point,
        Polygon,
        Polyline,
        Sphere,
        Torus,
        Vector,
    )

    return [
        (Mesh, conversions.mesh_to_rhino),
        (Polyline, conversions.polyline_to_rhino),
        (Polygon, conversions.polygon_to_rhino),
        (Line, conversions.line_to_rhino),
        (Circle, conversions.circle_to_rhino),
        (Ellipse, conversions.ellipse_to_rhino),
        (Box, conversions.box_to_rhino),
        (Sphere, conversions.sphere_to_rhino),
        (Cylinder, conversions.cylinder_to_rhino),
        (Cone, conversions.cone_to_rhino),
        (Torus, conversions.torus_to_rhino),
        (Frame, conversions.frame_to_rhino),
        (Plane, conversions.plane_to_rhino),
        (Point, conversions.point_to_rhino),
        (Vector, conversions.vector_to_rhino),
    ]


def to_rhino(obj, table):
    """Best-effort conversion. Returns None for types not in the table."""
    native = getattr(obj, "to_rhino", None)
    if callable(native):
        try:
            return native()
        except Exception:
            pass
    for cls, fn in table:
        if isinstance(obj, cls):
            try:
                return fn(obj)
            except Exception:
                return None
    return None


# ---------------------------------------------------------------------------

def run_script(broker, port, topic, codec, subscribe, auto_update, latest_only, reset):
    if reset:
        return False, [], [], [], "Unsubscribed from {} topic(s).".format(unsubscribe_all())

    if not subscribe:
        return False, [], [], [], "Set subscribe = True to start listening."

    try:
        host = require_text(broker, "broker")
        topic_name = require_text(topic, "topic")
        port_number = int(port) if port else DEFAULT_PORT

        codec_obj, codec_name = build_codec(codec)
        transport, transport_key = get_transport(host, port_number, codec_name, codec_obj)

        component = ghenv.Component  # noqa: F821 - injected by the GH script editor
        entry = ensure_subscription(
            transport, transport_key, topic_name, component, bool(auto_update)
        )

        with entry["lock"]:
            raw = list(entry["messages"])
            total = entry["count"]

        if latest_only and raw:
            raw = raw[-1:]

        if not raw:
            return True, [], [], [], "Listening on '{}' at {}:{}. Nothing received yet.".format(
                topic_name, host, port_number
            )

        table = converter_table()
        data = []
        geometry = []
        unconverted = 0

        for message in raw:
            for obj in collect_data(rehydrate(message), []):
                data.append(obj)
                native = to_rhino(obj, table)
                if native is None:
                    unconverted += 1
                else:
                    geometry.append(native)

        note = ""
        if unconverted:
            note = " {} object(s) had no Rhino converter - see the `data` output.".format(
                unconverted
            )

        return (
            True,
            geometry,
            data,
            raw,
            "{} message(s) held, {} received in total.{}".format(len(raw), total, note),
        )

    except Exception as e:
        return False, [], [], [], "Subscribe failed: {}: {}".format(type(e).__name__, e)


(success, geometry, data, raw, message) = run_script(
    broker, port, topic, codec, subscribe, auto_update, latest_only, reset
)
# ---------- end mqtt_subscriber ----------
c_units = ConvertUnits(Data=mqtt_subscriber.geometry, Source=meters, Target=document_unit)
panel_8 = Panel(mqtt_subscriber.message)
panel_9 = Panel(mqtt_subscriber.success)

# ----
# Visualize Incoming Geometry
number_slider = Slider(100, range=0..100)
transparency = Slider(0, range=0..1)
create_material = CreateMaterial(
    Diffuse=ColourSwatch(SwatchColor=RGB(23, 130, 119)),
    Specular=RGB(255, 255, 255),
    Emission=RGB(0, 0, 0),
    Transparency=transparency,
    Shine=number_slider)
custom_preview = CustomPreview(Geometry=c_units, Material=create_material)

panel_10 = Panel(mqtt_publisher.success)
