# Grasshopper definition 261002_Arun_BrickAssembly.gh (Grasshopper 1.0.8)

# ---- group: Inputs
input_srf = Surface(<surface referenced from the Rhino model>)
width = Panel(".025")
height = Panel(".0125")
length = Panel(".05")
h_gap = Panel(Slider(0.01, range=0..50))
v_gap = Panel("0.001")

# ----
# Length + H_Gap (For Splitting Curves)
panel = Panel("1")
division = Division(A=h_gap, B=panel)
addition = Addition(A=length, B=division)

# ----
# Half of Length
panel_2 = Panel("2")
division_2 = Division(A=length, B=panel_2)

# ----
# Half of Height
panel_3 = Panel("2")
division_3 = Division(A=height, B=panel_3)

# ----
# Height + V_Gap
addition_2 = Addition(A=height, B=v_gap)

# ----
# Length + H_Gap
addition_3 = Addition(A=length, B=h_gap)

# ---- group: Horizontal Contours
pt = Point(Point(0, 0, 0))
Z = UnitZ(Factor=height)
xy = XYPlane(Origin=pt)
move = Move(Geometry=xy, Motion=Z)  # -> Geometry, Transform

Z_2 = UnitZ(Factor=1)
contour = Contour(Shape=input_srf, Point=move.Geometry, Direction=Z_2, Distance=addition_2)  # -> flatten(Contours)

item = ListItem(List=contour, Index=0, Wrap=True)
flip = FlipCurve(Curve=contour, Guide=item)  # -> Curve, Flag

# ---- group: Odd
panel_4 = Panel("""False
True""")
cull = CullPattern(List=flip.Curve, CullPattern=panel_4)
end = EndPoints(Curve=cull)  # -> Start, End
cir = Circle(Plane=end.End, Radius=addition)
cir_2 = Circle(Plane=end.Start, Radius=addition)
ccx = CurveCurve(CurveA=graft(cull), CurveB=graft(cir_2))  # -> Points, ParamsA, ParamsB
ccx_2 = CurveCurve(CurveA=graft(cull), CurveB=graft(cir))  # -> Points, ParamsA, ParamsB
merge = Merge(Data1=ccx.ParamsA, Data2=ccx_2.ParamsA)
shatter = Shatter(Curve=graft(cull), Parameters=merge)
item_2 = ListItem(List=shatter, Index="1", Wrap=True)  # -> flatten(Item)

# ---- group: Even
panel_5 = Panel("""True
False""")
cull_2 = CullPattern(List=flip.Curve, CullPattern=panel_5)
end_2 = EndPoints(Curve=cull_2)  # -> Start, End
cir_3 = Circle(Plane=end_2.Start, Radius=addition)
cir_4 = Circle(Plane=end_2.End, Radius=addition)
ccx_3 = CurveCurve(CurveA=graft(cull_2), CurveB=graft(cir_3))  # -> Points, ParamsA, ParamsB
ccx_4 = CurveCurve(CurveA=graft(cull_2), CurveB=graft(cir_4))  # -> Points, ParamsA, ParamsB
merge_2 = Merge(Data1=ccx_3.ParamsA, Data2=ccx_4.ParamsA)
shatter_2 = Shatter(Curve=graft(cull_2), Parameters=merge_2)
item_3 = ListItem(List=shatter_2, Index="1", Wrap=True)  # -> flatten(Item)

# ---- group: # of Bricks in Course
len = Length(Curve=flatten(item_3))
bnd = Bounds(Numbers=len)
dedomain = DeconstructDomain(Domain=bnd)  # -> Start, End

division_4 = Division(A=dedomain.Start, B=addition_3)
round = Round(Number=division_4)  # -> Nearest, Floor, Ceiling

panel_6 = Panel(len)

multiplication = Multiplication(A=round.Floor, B="2")

# ---- group: Compute Brick Fr / Grid
frames = CurveFrames(Curve=item_3, Count=multiplication)  # -> Frames, Parameters

# ---- group: Compute Brick Fr / First Brick's CP
cir_5 = Circle(Plane=end_2.End, Radius=division_2)
ccx_5 = CurveCurve(CurveA=graft(cull_2), CurveB=graft(cir_5))  # -> Points, ParamsA, ParamsB

# ---- group: Compute Brick Fr / Grid
frames_2 = CurveFrames(Curve=item_2, Count=multiplication)  # -> Frames, Parameters

# ---- group: Compute Brick Fr / Last Brick's CP
cir_6 = Circle(Plane=end_2.Start, Radius=division_2)
ccx_6 = CurveCurve(CurveA=graft(cull_2), CurveB=graft(cir_6))  # -> Points, ParamsA, ParamsB

# ---- group: Compute Brick Fr / Quarter of Length
division_5 = Division(A=length, B="4")

# ---- group: Compute Brick Fr
# Last Brick Frame
frame = CurveFrame(Curve=graft(cull_2), Parameter=ccx_6.ParamsA)

# Half Bricks' Frames
cir_7 = Circle(Plane=end.Start, Radius=division_5)
cir_8 = Circle(Plane=end.End, Radius=division_5)
ccx_7 = CurveCurve(CurveA=graft(cull), CurveB=graft(cir_7))  # -> Points, ParamsA, ParamsB
ccx_8 = CurveCurve(CurveA=graft(cull), CurveB=graft(cir_8))  # -> Points, ParamsA, ParamsB
merge_3 = Merge(Data1=ccx_7.ParamsA, Data2=ccx_8.ParamsA)  # -> simplify(Result)
frame_2 = CurveFrame(Curve=graft(cull), Parameter=merge_3)  # -> flatten(Frame)

frame_3 = CurveFrame(Curve=graft(cull_2), Parameter=ccx_5.ParamsA)

panel_7 = Panel("""False
True""")

panel_8 = Panel("""True
False""")

# ---- group: Compute Brick Fr / Bricks Frames
cull_3 = CullPattern(List=frames_2.Frames, CullPattern=panel_8)  # -> flatten(List)

cull_4 = CullPattern(List=frames.Frames, CullPattern=panel_7)

# ---- group: Compute Brick Fr
merge_4 = Merge(Data1=simplify(cull_4), Data2=simplify(frame_3), Data3=simplify(frame))  # -> flatten(Result)
viewer = ParamViewer(merge_4)

# ----
py3 = Python3Script(input_frames=merge_4)  # -> out, output_frames; inputs input_frames: list of Plane
# ---------- py3: Python ----------
"""Checks and normalize all the frames in a way that
x, y, and z axes are all folloing world axes."""

__author__ = "Arash Adel"
__version__ = "2023.10.03"

import rhinoscriptsyntax as rs
import Rhino.Geometry as rg


def check_reverse_vec(input_vec, base_dir):
    #Calculate the dot product and reverse if negative
    if rg.Vector3d.Multiply(input_vec, base_dir) < 0:
        new_vec = rg.Vector3d.Negate(input_vec)
    else:
        new_vec = input_vec
    return new_vec

#world axes
world_x = rg.Vector3d.XAxis
world_y = rg.Vector3d.YAxis
world_z = rg.Vector3d.ZAxis

# A list of new frames
output_frames = []

#check axes and reverse if necessary
for in_frame in input_frames:
    #check x and y axes
    x_axis = check_reverse_vec(in_frame.XAxis, world_x)
    y_axis = check_reverse_vec(in_frame.YAxis, world_y)
    # compute a new frame
    new_frame = rg.Plane(in_frame.Origin, x_axis, y_axis)
    output_frames.append(new_frame)
# ---------- end py3 ----------
py3_2 = Python3Script(input_frames=frame_2)  # -> out, output_frames; inputs input_frames: list of Plane; same code as py3
py3_3 = Python3Script(input_frames=cull_3)  # -> out, output_frames; inputs input_frames: list of Plane; same code as py3

# ---- group: Merge Bricks
box = CenterBox(Base=py3_3.output_frames, X=expr("x/2", length), Y=expr("x/2", width), Z=expr("x/2", height))  # -> simplify(Box)
box_2 = CenterBox(Base=py3_2.output_frames, X=expr("x/4", length), Y=expr("x/2", width), Z=expr("x/2", height))  # -> simplify(Box)
merge_5 = Merge(Data1=box, Data2=box_2)

box_3 = CenterBox(Base=py3.output_frames, X=expr("x/2", length), Y=expr("x/2", width), Z=expr("x/2", height))  # -> simplify(Box)

merge_6 = Merge(Data1=box_3, Data2=merge_5)
flatten = FlattenTree(Tree=merge_6, Path="{0}")

# ---- group: Sequence
py3_4 = Python3Script(bricks=flatten, course_index=Slider(0, range=0..50), sort_bricks=Toggle(True))  # -> out, sorted_bricks, brick_wall_courses, course_bricks; inputs bricks: list of Box, course_index: Int32, sort_bricks: Boolean
# ---------- py3_4: Python ----------
__author__ = "aa9663"
__version__ = "2023.09.11"

import rhinoscriptsyntax as rs
import Rhino.Geometry as rg
import math

courses = []
brick_wall_courses = []

sorted_bricks = sorted(bricks, key = lambda brick: (math.floor(brick.Center.Z), math.floor(brick.Center.X)))

current_z = round(bricks[0].Center.Z, 0)
current_course_bricks = []

if sort_bricks:
    for brick in sorted_bricks:
        #brick = rg.Box(brick)
        #print(brick)
        if round(brick.Center.Z, 0) > current_z:
            current_z = round(brick.Center.Z, 0)
            brick_wall_courses.append(current_course_bricks)
            current_course_bricks = []
            current_course_bricks.append(brick)
        else:
            current_course_bricks.append(brick)
    
    #Append the last course
    brick_wall_courses.append(current_course_bricks)
    
    course_bricks = brick_wall_courses[course_index]
# ---------- end py3_4 ----------
# Define End Effector Tool
# House Keeping
# Task 0: Open Gripper
# Task 1: Joint Move to Home Position
# Task 2: Joint Move to Lead-in Frame (Pick up a Brick)
# Task 3: Linear Move to Pick-up Frame
# Task 4: Wait for 1 Second
# Visualization
# Task 5: Close Gripper
# Task 6: Wait for 1 Second
# Task 7: Linear Move to Lead-Out Frame
# Merge Tasks Instructions
# RAPID Code Generation
# Grafting before Merge
# Data Matching
# (Longest List)
# Task 8: Joint Move to Home Position
# Flatten the Instructions
# Task 9: Joint Move to Lead-in Frame (Place Brick)
# Task 10: Linear Move to Placement Frame
# Task 11: Wait for 1 Second
# Task 12: Open Gripper
# Task 13: Wait for 1 Second
# Task 14: Linear Move to Lead-Out Frame
# Task 15: Joint Move to Home Position
item_4 = ListItem(List=py3_4.sorted_bricks, Index=Slider(0, range=0..500), Wrap=True)

# ----
box_4 = Box(py3_4.course_bricks)
