# Grasshopper definition 261002_VK_BrickAssembly_rhino2unity.gh (Grasshopper 1.0.8)
# plug-ins: Bifocals, LunchBox

panel = Panel("0.15")  # disabled
pt = ConstructPoint(XCoordinate=0, YCoordinate=0, ZCoordinate=panel)  # disabled
panel_2 = Panel("0.21")  # disabled
panel_3 = Panel("0.14")  # disabled
panel_4 = Panel("2")  # disabled
rectangle = Rectangle(Plane=pt, XSize=panel_2, YSize=panel_3, Radius=0)  # -> Rectangle, Length; disabled
multiplication = Multiplication(A=panel_3, B=panel_4)  # disabled
panel_5 = Panel("0.075")  # disabled
multiplication_2 = Multiplication(A=panel_5, B=panel_4)  # disabled
Z = UnitZ(Factor=panel_5)  # disabled
extr = Extrude(Base=rectangle.Rectangle, Direction=Z)  # disabled
cap = CapHoles(Brep=extr)  # disabled
number_slider = Slider(4, range=0..100)  # disabled
number_slider_2 = Slider(1, range=0..100)  # disabled
X = UnitX(Factor=multiplication)  # disabled
Z_2 = UnitZ(Factor=multiplication_2)  # disabled
arrlinear = LinearArray(Geometry=cap, Direction=X, Count=number_slider)  # -> Geometry, Transform; disabled
arrlinear_2 = LinearArray(Geometry=arrlinear.Geometry, Direction=Z_2, Count=number_slider_2)  # -> Geometry, Transform; disabled
panel_6 = Panel("2")  # disabled
division = Division(A=multiplication_2, B=panel_6)  # disabled
division_2 = Division(A=multiplication, B=panel_6)  # disabled
vec = VectorXYZ(XComponent=division_2, YComponent=0, ZComponent=division)  # -> Vector, Length; disabled
move = Move(Geometry=arrlinear_2.Geometry, Motion=vec.Vector)  # -> Geometry, Transform; disabled
merge = Merge(Data1=arrlinear_2.Geometry, Data2=move.Geometry)  # disabled
bbox = BoundingBox(Content=flatten(merge), Plane=PlaneXY(0, 0, 0), UnionBox=True)  # -> Box, Box_2; disabled
boxprop = BoxProperties(Box=merge)  # -> Center, Diagonal, Area, Volume, Degeneracy; disabled
debrep = DeconstructBrep(Brep=bbox.Box)  # -> Faces, Edges, Vertices; disabled
panel_7 = Panel("0")  # disabled
item = ListItem(List=debrep.Faces, Index=panel_7, Wrap=True)  # disabled
srf_cp = SurfaceClosestPoint(Point=boxprop.Center, Surface=reparameterize(item))  # -> Point, UVPoint, Distance; disabled
number_slider_3 = Slider(31, range=0..100)  # disabled
image = ImageSampler(srf_cp.UVPoint, Filter="Value", Interpolate=False, Umax=0.1, Umin=0, Vmax=0.1, Vmin=0, Wrap=1)  # disabled
multiplication_3 = Multiplication(A=number_slider_3, B=image)  # disabled
rotate = Rotate(Geometry=merge, Angle=degrees(multiplication_3), Plane=boxprop.Center)  # -> Geometry, Transform; disabled

number_slider_4 = Slider(11, range=0..100)  # disabled
number_slider_5 = Slider(1.2, range=0..10)  # disabled
sph = Sphere(Base=PlaneXY(0, 0, 0), Radius=number_slider_5)  # disabled
trib = TrianglePanelsB(Surface=sph, UDivisions=number_slider_4, VDivisions=number_slider_4)  # disabled

# ---- group: Inputs
input_srf = Surface(<surface referenced from the Rhino model>)
width = Panel(".025")
height = Panel(".0125")
length = Panel(".05")
h_gap = Panel(Slider(0.01, range=0..50))
v_gap = Panel(".001")

# ----
# Length + H_Gap (For Splitting Curves)
panel_8 = Panel("1")
division_3 = Division(A=h_gap, B=panel_8)
addition = Addition(A=length, B=division_3)

# ----
# Half of Length
panel_9 = Panel("2")
division_4 = Division(A=length, B=panel_9)

# ----
# Half of Height
panel_10 = Panel("2")
division_5 = Division(A=height, B=panel_10)

# ----
# Height + V_Gap
addition_2 = Addition(A=height, B=v_gap)

# ----
# Length + H_Gap
addition_3 = Addition(A=length, B=h_gap)

clean = CombineClean(Meshes=trib)  # disabled

panel_11 = Panel("{0,0,1}")  # disabled
move_2 = Move(Geometry=clean, Motion=panel_11)  # -> Geometry, Transform; disabled
set_one_geometry = Geometry(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)  # disabled
cone = Geometry(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)  # disabled
torus = Geometry(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)  # disabled
sphere = Geometry(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)  # disabled
geo = Geometry(move_2.Geometry)  # disabled
merge_2 = Merge(Data1=set_one_geometry, Data2=sphere, Data3=torus, Data4=cone, Data5=geo, Data6=sph)  # -> flatten(Result); disabled
number_slider_6 = Slider(0.19, range=0..1)  # disabled
scale = Scale(Geometry=merge_2, Center=Point(0, 0, 0), Factor=number_slider_6)  # -> Geometry, Transform; disabled

# ---- group: Horizontal Contours
pt_2 = Point(Point(0, 0, 0))
Z_3 = UnitZ(Factor=height)
xy = XYPlane(Origin=pt_2)
move_3 = Move(Geometry=xy, Motion=Z_3)  # -> Geometry, Transform

Z_4 = UnitZ(Factor=1)
contour = Contour(Shape=input_srf, Point=move_3.Geometry, Direction=Z_4, Distance=addition_2)  # -> flatten(Contours)

# ----
number_slider_7 = Slider(0.3, range=0..100)  # disabled

# ---- group: Horizontal Contours
item_2 = ListItem(List=contour, Index=0, Wrap=True)
flip = FlipCurve(Curve=contour, Guide=item_2)  # -> Curve, Flag

# ----
Z_5 = UnitZ(Factor=number_slider_7)  # disabled
move_4 = Move(Geometry=scale.Geometry, Motion=Z_5)  # -> Geometry, Transform; disabled

# ----
# Step 0. Order your Geometry
# 1. Geometry: Set multiple objects or connect to Geometry
# 2. Set order geometry "True"
# 3. Click on geometry in the rhino viewport to order. To deselect and reorder click again. To start over click START OVER button in gh. Press escape when done.
# 4. slide index
geometry = Geometry(move_4.Geometry)  # disabled
start_over = Button()  # disabled
order_geometry = BooleanToggle(False)  # disabled
order_geo = Python3Script(geometry=geometry, pick=order_geometry, reset=start_over)  # -> order, geometry; inputs geometry: list of GeometryBase, pick: Boolean, reset: Boolean; disabled
# ---------- order_geo: Python ----------
"""
Geometry Orderer - click geometry in Rhino to set its order.
Colours + numbers are drawn by the component itself.
Inputs:  B (GeometryBase or no type hint, list access): Breps, Meshes, Extrusions, Surfaces, SubDs
         pick (bool, toggle or button), reset (bool, button)
Outputs: order    (indices in picked order)
         geometry (geometry sorted by picked order -> List Item 3 = object labelled 3)
"""
import math
import Rhino
import Rhino.Geometry as rg
import Rhino.Display as rd
import scriptcontext as sc
import System.Drawing as sd

# ---- settings ----
C_START    = sd.Color.FromArgb(255, 60, 120, 255)   # first picked
C_END      = sd.Color.FromArgb(255, 255, 70, 60)    # last picked
C_NONE     = sd.Color.FromArgb(255, 190, 190, 190)  # not picked
C_EDGE     = sd.Color.FromArgb(255, 40, 40, 40)
C_TEXT     = sd.Color.White
TEXT_SIZE  = 18    # pixels
CREASE_DEG = 20.0  # mesh edges sharper than this get drawn as outlines

REG  = "geo_orderer_states_v5"
HOOK = "geo_orderer_hook_v5"

# silence the old version's hook if it's still loaded this session
for old in ():
    if old in sc.sticky:
        sc.sticky[old].clear()


def as_list(x):
    if x is None:
        return []
    if isinstance(x, rg.GeometryBase):
        return [x]
    try:
        return list(x)
    except TypeError:
        return [x]


def unwrap(obj):
    """GH goo -> RhinoCommon geometry."""
    if obj is None:
        return None
    if not isinstance(obj, rg.GeometryBase) and hasattr(obj, "Value"):
        return unwrap(obj.Value)
    return obj


def display_mesh(geo):
    """Any supported geometry -> one joined mesh for drawing + picking. None if unsupported."""
    if isinstance(geo, rg.Mesh):
        return geo.DuplicateMesh()
    if hasattr(rg, "SubD") and isinstance(geo, rg.SubD):
        try:
            return rg.Mesh.CreateFromSubD(geo, 2)
        except Exception:
            geo = geo.ToBrep()
    if isinstance(geo, (rg.Extrusion, rg.Surface)):
        geo = geo.ToBrep()
    if isinstance(geo, rg.Brep):
        m = rg.Mesh()
        for part in (rg.Mesh.CreateFromBrep(geo, rg.MeshingParameters.FastRenderMesh) or []):
            m.Append(part)
        return m
    return None


def outline_lines(geo, mesh):
    """Clean outline: Brep edges, or creased/naked mesh edges (no triangle wires)."""
    lines = []
    if isinstance(geo, rg.Brep):
        for crv in geo.DuplicateEdgeCurves(False):
            pl = crv.ToPolyline(0.01, 0.1, 0.0, 0.0)
            if pl is not None:
                lines.extend(pl.ToPolyline().GetSegments())
        return lines
    mesh.FaceNormals.ComputeFaceNormals()
    cos_lim = math.cos(math.radians(CREASE_DEG))
    te = mesh.TopologyEdges
    for i in range(te.Count):
        faces = te.GetConnectedFaces(i)
        if len(faces) != 2:
            lines.append(te.EdgeLine(i))
            continue
        n0 = mesh.FaceNormals[faces[0]]
        n1 = mesh.FaceNormals[faces[1]]
        if n0.X * n1.X + n0.Y * n1.Y + n0.Z * n1.Z < cos_lim:
            lines.append(te.EdgeLine(i))
    return lines


def lerp(a, b, t):
    return sd.Color.FromArgb(255,
        int(a.R + (b.R - a.R) * t),
        int(a.G + (b.G - a.G) * t),
        int(a.B + (b.B - a.B) * t))


def update_mats(st):
    n = len(st["order"])
    cols = [st["c_none"]] * len(st["meshes"])
    for k, i in enumerate(st["order"]):
        t = k / float(n - 1) if n > 1 else 0.0
        cols[i] = lerp(st["c_start"], st["c_end"], t)
    st["mats"] = [rd.DisplayMaterial(c) for c in cols]


def reset_pick_toggle(c):
    """Set any Boolean Toggle wired into 'pick' back to False."""
    for p in c.Params.Input:
        if p.NickName != "pick":
            continue
        for src in p.Sources:
            if src.GetType().Name == "GH_BooleanToggle":
                src.Value = False
                src.ExpireSolution(False)


# ---- one shared display hook for all geometry orderer components ----
if REG not in sc.sticky:
    sc.sticky[REG] = {}
states = sc.sticky[REG]


def draw_all(sender, e):
    for g, st in list(states.items()):
        c = st["comp"]
        if c.OnPingDocument() is None:
            states.pop(g, None)
            continue
        if c.Locked:
            continue
        for m, mat in zip(st["meshes"], st["mats"]):
            e.Display.DrawMeshShaded(m, mat)
        for ln in st["edges"]:
            e.Display.DrawLine(ln, st["c_edge"], 1)
        for k, i in enumerate(st["order"]):
            e.Display.Draw2dText(str(k), st["c_text"], st["cents"][i], True, st["size"])


def bbox_all(sender, e):
    for st in list(states.values()):
        c = st["comp"]
        if c.OnPingDocument() is not None and not c.Locked:
            e.IncludeBoundingBox(st["bbox"])


if HOOK not in sc.sticky:
    rd.DisplayPipeline.PostDrawObjects += draw_all
    rd.DisplayPipeline.CalculateBoundingBox += bbox_all
    sc.sticky[HOOK] = (draw_all, bbox_all)


# ---- state for this component ----
comp = ghenv.Component
gid = str(comp.InstanceGuid)
if gid not in states:
    states[gid] = {"order": [], "picking": False}
st = states[gid]
if reset:
    st["order"] = []

Gs, meshes, edges, cents = [], [], [], []
bbox = rg.BoundingBox.Empty
skipped = 0
for item in as_list(geometry):
    geo = unwrap(item)
    if geo is None:
        continue
    m = display_mesh(geo)
    if m is None or m.Faces.Count == 0:
        skipped += 1
        continue
    Gs.append(geo)
    meshes.append(m)
    edges.extend(outline_lines(geo, m))
    bb = m.GetBoundingBox(False)
    cents.append(bb.Center)
    bbox.Union(bb)

if skipped:
    print("{} item(s) skipped (not Brep/Mesh/Extrusion/Surface/SubD)".format(skipped))

st.update({
    "comp": comp, "G": Gs, "meshes": meshes, "edges": edges,
    "cents": cents, "bbox": bbox,
    "c_start": C_START, "c_end": C_END, "c_none": C_NONE,
    "c_edge": C_EDGE, "c_text": C_TEXT, "size": TEXT_SIZE,
})
st["order"] = [i for i in st["order"] if i < len(Gs)]
update_mats(st)


# ---- picking: runs AFTER the Grasshopper solution, not inside it ----
def run_pick(sender, e):
    Rhino.RhinoApp.Idle -= st["idle"]
    rdoc = Rhino.RhinoDoc.ActiveDoc
    try:
        while True:
            gp = Rhino.Input.Custom.GetPoint()
            gp.SetCommandPrompt("Click object #{} (Enter/Esc to finish)".format(len(st["order"])))
            gp.AcceptNothing(True)
            if gp.Get() != Rhino.Input.GetResult.Point:
                break
            line = gp.View().ActiveViewport.ClientToWorld(gp.Point2d())
            ray = rg.Ray3d(line.From, line.Direction)
            best, best_t = None, None
            for i, m in enumerate(st["meshes"]):
                t = rg.Intersect.Intersection.MeshRay(m, ray)
                if t >= 0 and (best_t is None or t < best_t):
                    best, best_t = i, t
            if best is None:
                continue
            if best in st["order"]:
                st["order"].remove(best)
            else:
                st["order"].append(best)
            update_mats(st)
            rdoc.Views.Redraw()
    finally:
        c = st["comp"]
        reset_pick_toggle(c)
        st["picking"] = False
        c.ExpireSolution(True)


if pick and Gs and not st["picking"]:
    st["picking"] = True
    st["idle"] = run_pick
    Rhino.RhinoApp.Idle += run_pick

Rhino.RhinoDoc.ActiveDoc.Views.Redraw()

# ---- outputs ----
order = list(st["order"])
geometry = [Gs[i] for i in st["order"]]
# ---------- end order_geo ----------
panel_12 = Panel(order_geo.geometry)  # disabled

# ---- group: Odd
panel_13 = Panel("""False
True""")
cull = CullPattern(List=flip.Curve, CullPattern=panel_13)
end = EndPoints(Curve=cull)  # -> Start, End
cir = Circle(Plane=end.End, Radius=addition)
cir_2 = Circle(Plane=end.Start, Radius=addition)
ccx = CurveCurve(CurveA=graft(cull), CurveB=graft(cir_2))  # -> Points, ParamsA, ParamsB
ccx_2 = CurveCurve(CurveA=graft(cull), CurveB=graft(cir))  # -> Points, ParamsA, ParamsB
merge_3 = Merge(Data1=ccx.ParamsA, Data2=ccx_2.ParamsA)
shatter = Shatter(Curve=graft(cull), Parameters=merge_3)
item_3 = ListItem(List=shatter, Index="1", Wrap=True)  # -> flatten(Item)

# ---- group: Even
panel_14 = Panel("""True
False""")
cull_2 = CullPattern(List=flip.Curve, CullPattern=panel_14)
end_2 = EndPoints(Curve=cull_2)  # -> Start, End
cir_3 = Circle(Plane=end_2.Start, Radius=addition)
cir_4 = Circle(Plane=end_2.End, Radius=addition)
ccx_3 = CurveCurve(CurveA=graft(cull_2), CurveB=graft(cir_3))  # -> Points, ParamsA, ParamsB
ccx_4 = CurveCurve(CurveA=graft(cull_2), CurveB=graft(cir_4))  # -> Points, ParamsA, ParamsB
merge_4 = Merge(Data1=ccx_3.ParamsA, Data2=ccx_4.ParamsA)
shatter_2 = Shatter(Curve=graft(cull_2), Parameters=merge_4)
item_4 = ListItem(List=shatter_2, Index="1", Wrap=True)  # -> flatten(Item)

# ---- group: # of Bricks in Course
len = Length(Curve=flatten(item_4))
bnd = Bounds(Numbers=len)
dedomain = DeconstructDomain(Domain=bnd)  # -> Start, End

division_6 = Division(A=dedomain.Start, B=addition_3)

round = Round(Number=division_6)  # -> Nearest, Floor, Ceiling

panel_15 = Panel(len)

multiplication_4 = Multiplication(A=round.Floor, B="2")

# ---- group: Compute Brick Fr / Grid
frames = CurveFrames(Curve=item_4, Count=multiplication_4)  # -> Frames, Parameters

# ---- group: Compute Brick Fr / First Brick's CP
cir_5 = Circle(Plane=end_2.End, Radius=division_4)
ccx_5 = CurveCurve(CurveA=graft(cull_2), CurveB=graft(cir_5))  # -> Points, ParamsA, ParamsB

# ---- group: Compute Brick Fr / Grid
frames_2 = CurveFrames(Curve=item_3, Count=multiplication_4)  # -> Frames, Parameters

# ---- group: Compute Brick Fr / Last Brick's CP
cir_6 = Circle(Plane=end_2.Start, Radius=division_4)
ccx_6 = CurveCurve(CurveA=graft(cull_2), CurveB=graft(cir_6))  # -> Points, ParamsA, ParamsB

# ---- group: Compute Brick Fr / Quarter of Length
division_7 = Division(A=length, B="4")

# ---- group: Compute Brick Fr
# Last Brick Frame
frame = CurveFrame(Curve=graft(cull_2), Parameter=ccx_6.ParamsA)

# Half Bricks' Frames
cir_7 = Circle(Plane=end.Start, Radius=division_7)
cir_8 = Circle(Plane=end.End, Radius=division_7)
ccx_7 = CurveCurve(CurveA=graft(cull), CurveB=graft(cir_7))  # -> Points, ParamsA, ParamsB
ccx_8 = CurveCurve(CurveA=graft(cull), CurveB=graft(cir_8))  # -> Points, ParamsA, ParamsB
merge_5 = Merge(Data1=ccx_7.ParamsA, Data2=ccx_8.ParamsA)  # -> simplify(Result)
frame_2 = CurveFrame(Curve=graft(cull), Parameter=merge_5)  # -> flatten(Frame)

frame_3 = CurveFrame(Curve=graft(cull_2), Parameter=ccx_5.ParamsA)

panel_16 = Panel("""False
True""")

panel_17 = Panel("""True
False""")

# ---- group: Compute Brick Fr / Bricks Frames
cull_3 = CullPattern(List=frames_2.Frames, CullPattern=panel_17)  # -> flatten(List)

cull_4 = CullPattern(List=frames.Frames, CullPattern=panel_16)

# ---- group: Compute Brick Fr
merge_6 = Merge(Data1=simplify(cull_4), Data2=simplify(frame_3), Data3=simplify(frame))  # -> flatten(Result)

viewer = ParamViewer(merge_6)

# ----
py3 = Python3Script(input_frames=merge_6)  # -> out, output_frames; inputs input_frames: list of Plane
# ---------- py3: Python ----------
"""Checks and normalize all the frames in a way that
x, y, and z axes are all folloing world axes."""

__author__ = "Arash Adel"
__version__ = "2023.10.03"

import rhinoscriptsyntax as rs
import Rhino.Geometry as rg


def check_reverse_vec(input_vec, base_dir):
    #Calculate the dot product and reverse if negative
    if rg.Vector3d.Multiply(input_vec, base_dir) < 0:
        new_vec = rg.Vector3d.Negate(input_vec)
    else:
        new_vec = input_vec
    return new_vec

#world axes
world_x = rg.Vector3d.XAxis
world_y = rg.Vector3d.YAxis
world_z = rg.Vector3d.ZAxis

# A list of new frames
output_frames = []

#check axes and reverse if necessary
for in_frame in input_frames:
    #check x and y axes
    x_axis = check_reverse_vec(in_frame.XAxis, world_x)
    y_axis = check_reverse_vec(in_frame.YAxis, world_y)
    # compute a new frame
    new_frame = rg.Plane(in_frame.Origin, x_axis, y_axis)
    output_frames.append(new_frame)
# ---------- end py3 ----------
py3_2 = Python3Script(input_frames=frame_2)  # -> out, output_frames; inputs input_frames: list of Plane; same code as py3
py3_3 = Python3Script(input_frames=cull_3)  # -> out, output_frames; inputs input_frames: list of Plane; same code as py3

# ---- group: Merge Bricks
box = CenterBox(Base=py3_3.output_frames, X=expr("x/2", length), Y=expr("x/2", width), Z=expr("x/2", height))  # -> simplify(Box)
box_2 = CenterBox(Base=py3_2.output_frames, X=expr("x/4", length), Y=expr("x/2", width), Z=expr("x/2", height))  # -> simplify(Box)
merge_7 = Merge(Data1=box, Data2=box_2)

box_3 = CenterBox(Base=py3.output_frames, X=expr("x/2", length), Y=expr("x/2", width), Z=expr("x/2", height))  # -> simplify(Box)

merge_8 = Merge(Data1=box_3, Data2=merge_7)
flatten = FlattenTree(Tree=merge_8, Path="{0}")

# ---- group: Sequence
py3_4 = Python3Script(bricks=flatten, course_index=Slider(0, range=0..50), sort_bricks=Toggle(True))  # -> out, sorted_bricks, brick_wall_courses, course_bricks; inputs bricks: list of Box, course_index: Int32, sort_bricks: Boolean
# ---------- py3_4: Python ----------
import rhinoscriptsyntax as rs
import Rhino.Geometry as rg
import math

courses = []
brick_wall_courses = []

# Tolerance for "same course": half the shortest brick height
heights = [brick.BoundingBox.Max.Z - brick.BoundingBox.Min.Z for brick in bricks]
heights = [h for h in heights if h > 1e-9]
z_tol = min(heights) * 0.5 if heights else 0.01

# Dominant horizontal axis of the wall, used to pick which end the first course starts from
xs = [brick.Center.X for brick in bricks]
ys = [brick.Center.Y for brick in bricks]
if (max(xs) - min(xs)) >= (max(ys) - min(ys)):
    along_wall = lambda brick: (brick.Center.X, brick.Center.Y)
else:
    along_wall = lambda brick: (brick.Center.Y, brick.Center.X)


def order_course(course, start_hint):
    """Orders one course by walking from brick to nearest brick, starting at one end.
    start_hint is the first brick centre of the course below (None for the first course)."""
    if len(course) < 2:
        return list(course)
    
    pts = [brick.Center for brick in course]
    n = len(pts)
    
    #Find the end bricks: their two nearest neighbours both lie on the same side
    ends = []
    if n == 2:
        ends = [0, 1]
    else:
        for i in range(n):
            others = sorted([j for j in range(n) if j != i], key = lambda j: pts[i].DistanceTo(pts[j]))
            v1 = pts[others[0]] - pts[i]
            v2 = pts[others[1]] - pts[i]
            if (v1.X * v2.X + v1.Y * v2.Y + v1.Z * v2.Z) > 0:
                ends.append(i)
    
    #Closed loop (no ends found): any brick can be the start
    if not ends:
        ends = list(range(n))
    
    #Start at the same end of the wall for every course
    if start_hint is None:
        start = min(ends, key = lambda i: along_wall(course[i]))
    else:
        start = min(ends, key = lambda i: pts[i].DistanceTo(start_hint))
    
    #Walk along the course, always stepping to the nearest brick not yet used
    order = [start]
    remaining = [i for i in range(n) if i != start]
    while remaining:
        last = pts[order[-1]]
        nearest = min(remaining, key = lambda j: last.DistanceTo(pts[j]))
        remaining.remove(nearest)
        order.append(nearest)
    
    return [course[i] for i in order]


sorted_bricks = sorted(bricks, key = lambda brick: brick.Center.Z)

current_z = sorted_bricks[0].Center.Z
current_course_bricks = []

if sort_bricks:
    for brick in sorted_bricks:
        #brick = rg.Box(brick)
        #print(brick)
        if brick.Center.Z - current_z > z_tol:
            current_z = brick.Center.Z
            brick_wall_courses.append(current_course_bricks)
            current_course_bricks = []
            current_course_bricks.append(brick)
        else:
            current_course_bricks.append(brick)
    
    #Append the last course
    brick_wall_courses.append(current_course_bricks)
    
    #Order the bricks within each course along the wall
    ordered_courses = []
    start_hint = None
    for course in brick_wall_courses:
        course = order_course(course, start_hint)
        start_hint = course[0].Center
        ordered_courses.append(course)
    brick_wall_courses = ordered_courses
    
    #Flat list in final order: course by course, then along the wall
    sorted_bricks = [brick for course in brick_wall_courses for brick in course]
    
    course_bricks = brick_wall_courses[course_index]
# ---------- end py3_4 ----------
item_5 = ListItem(List=py3_4.sorted_bricks, Index=Slider(500, range=0..500), Wrap=True)

# ----
# !!! ALWAYS WORK IN METERS !!!
# Step 1. Set Geometry from Rhino
# 1. Create or import your geometry (fbx, obj)
# 2. Order the geometries to sent to Unity
# 3. Connect in Unity
# 4. Press Sent
rhino_geometry = Geometry(py3_4.sorted_bricks)

list_item = ListItem(List=rhino_geometry, Index=Slider(9, range=0..100), Wrap=True)
geometry_2 = Geometry(list_item)

# ----
# Convert the geometry into data (compas)
geometry_payload_prep = Python3Script(geometry=rhino_geometry)  # -> payload, summary; inputs geometry: list
# ---------- geometry_payload_prep: Python ----------
#! python 3
# venv: venv-compas-xr2.2
# r: compas==2.13.0, compas_model==0.9.3, compas_eve==2.3.0, compas_pb==1.0.0

"""Convert ordered Rhino geometry into a COMPAS Model payload.

Geometry in, COMPAS JSON string out. The position in the input list IS the
build order: item 0 is element 0, item 3 is element 3 - whatever its type.
Wire the `geometry` output of the Geometry Orderer (Order Geo) straight in.

Component inputs
    geometry   List Access, type hint: object

Component outputs
    payload    COMPAS Model as a JSON string
    summary    counts, skipped items, diagnostics

Every input item becomes one compas_model Element, added to the model in
input order. Its tree node carries three attributes:

    order   int, the index in the input list (= the number you clicked)
    kind    "box" | "cylinder" | "sphere" | "mesh" | "point" | "points"
    shape   the COMPAS shape (Box, Cylinder, Sphere, Mesh, Point, [Point])

The shape lives on the tree node rather than on the element because a plain
compas_model Element does not serialise its geometry. Tree node attributes
are serialised, and only use standard COMPAS classes, so any receiver with
compas + compas_model installed can json_loads the payload - no custom class
has to be importable.

Reading it in Unity: data.tree.root.children is the ordered list. Each child
has attributes.order, attributes.kind and attributes.shape.

Requirements: compas >= 2.1.1 (2.0.4 cannot load a Model back from JSON) and
compas_model. Change the `# r:` lines in every component that shares this
venv, otherwise they reinstall different compas versions against each other.

Dispatch
    Point3d / Point .................... point
    PointCloud ......................... points
    Mesh / SubD ........................ mesh
    Box / BoundingBox .................. box
    Brep / Surface / Extrusion ......... box, sphere or cylinder if it passes
                                         the tests below, otherwise a mesh
    anything else ...................... skipped, listed in `summary`

Primitives are matched as whole solids, never a single face: a filleted box
has a spherical corner face and is still not a sphere.

    sphere     closed solid, exactly 1 spherical face
    cylinder   one cylindrical wall face, either alone (an open tube, when
               ACCEPT_UNCAPPED is on) or as the single curved face of a
               closed 3-face solid whose two planar caps sit perpendicular to
               the axis, spaced by exactly the cylinder height
    box        closed solid, exactly 6 planar faces whose normals resolve to
               exactly 3 mutually perpendicular axes

Anything else is tessellated. Nothing is approximated into a primitive it is
not.
"""

import Rhino.Geometry as rg
import scriptcontext as sc
from System import Guid

import compas
from compas.data import json_dumps
from compas.geometry import Cylinder
from compas.geometry import Sphere
from compas_model.elements import Element
from compas_model.models import Model
from compas_rhino.conversions import box_to_compas
from compas_rhino.conversions import mesh_to_compas
from compas_rhino.conversions import plane_to_compas_frame
from compas_rhino.conversions import point_to_compas

# Explain in `summary` how each primitive was matched, and why anything
# surface-like was meshed instead. Switch on when something misbehaves.
DIAGNOSTICS = False

# Accept an open cylindrical tube as a cylinder.
ACCEPT_UNCAPPED = True

# Allow the edge-based cylinder route. Off means analytic matching only.
CYLINDER_FROM_EDGES = True

# How far off parallel a direction may be, as a dot product.
ANGLE_EPS = 1e-4

# Element names: element_000, element_001, ...
NAME_FORMAT = "element_{:03d}"
MODEL_NAME = "geometry_sequence"


def tolerance():
    return sc.doc.ModelAbsoluteTolerance if sc.doc else 1e-3


def fit_tolerances():
    """Model tolerance, then a looser pass for NURBS approximations."""
    tol = tolerance()
    return (tol, tol * 10.0)


# ---------------------------------------------------------------------------
# input handling
# ---------------------------------------------------------------------------

def ensure_list(value):
    """None, a single item, or a sequence -> list. Keeps None entries so the
    index of every item stays equal to its position in the input."""
    if value is None:
        return []
    if isinstance(value, str):
        return [value]
    try:
        return list(value)
    except TypeError:
        return [value]


def guid_to_geometry(gid):
    rhobj = sc.doc.Objects.FindId(gid) if sc.doc else None
    return rhobj.Geometry if rhobj else None


def unwrap_geometry(obj):
    """Resolve GH wrappers, Rhino 8 model objects and GUIDs to RhinoCommon."""
    if obj is None:
        return None
    if isinstance(obj, Guid):
        return guid_to_geometry(obj)
    if hasattr(obj, "Value") and not isinstance(obj, (str, int, float)):
        return unwrap_geometry(obj.Value)
    if hasattr(obj, "Geometry") and obj.Geometry is not None:
        return obj.Geometry
    if hasattr(obj, "ObjectId"):
        return guid_to_geometry(obj.ObjectId)
    if hasattr(obj, "Id") and isinstance(getattr(obj, "Id"), Guid):
        resolved = guid_to_geometry(obj.Id)
        if resolved is not None:
            return resolved
    return obj


def as_brep(geo):
    """Anything surface-like, as a Brep. None if it is not surface-like."""
    if isinstance(geo, rg.Brep):
        return geo
    if isinstance(geo, (rg.Extrusion, rg.Surface)):
        return geo.ToBrep()
    return None


# ---------------------------------------------------------------------------
# geometry helpers
# ---------------------------------------------------------------------------

def dot(a, b):
    return a.X * b.X + a.Y * b.Y + a.Z * b.Z


def unit(vector):
    u = rg.Vector3d(vector)
    u.Unitize()
    return u


def parallel(a, b):
    return abs(dot(unit(a), unit(b))) > 1.0 - ANGLE_EPS


def face_plane(face):
    ok, plane = face.TryGetPlane(tolerance())
    return plane if ok else None


def surfaces_of(face):
    surfaces = [face]
    try:
        srf = face.UnderlyingSurface()
        if srf is not None:
            surfaces.append(srf)
    except Exception:
        pass
    return surfaces


def try_get(srf, name, tol):
    method = getattr(srf, name, None)
    if method is None:
        return None
    for args in ((tol,), ()):
        try:
            ok, result = method(*args)
        except Exception:
            continue
        if ok and result is not None:
            return result
    return None


# ---------------------------------------------------------------------------
# finding a cylinder
# ---------------------------------------------------------------------------

def analytic_cylinder(face):
    for srf in surfaces_of(face):
        for tol in fit_tolerances():
            cylinder = try_get(srf, "TryGetFiniteCylinder", tol)
            if cylinder is not None and cylinder.IsFinite:
                return cylinder
            cylinder = try_get(srf, "TryGetCylinder", tol)
            if cylinder is not None:
                return finite(cylinder, face)
    return None


def finite(cylinder, face):
    if cylinder.IsFinite:
        return cylinder
    axis = unit(cylinder.Axis)
    origin = cylinder.Center
    for srf in surfaces_of(face):
        try:
            u = srf.Domain(0)
            v = srf.Domain(1)
            corners = [
                srf.PointAt(u.Min, v.Min),
                srf.PointAt(u.Min, v.Max),
                srf.PointAt(u.Max, v.Min),
                srf.PointAt(u.Max, v.Max),
            ]
        except Exception:
            continue
        values = [dot(corner - origin, axis) for corner in corners]
        low, high = min(values), max(values)
        if high - low <= tolerance():
            return None
        base = rg.Plane(origin + axis * low, axis)
        return rg.Cylinder(rg.Circle(base, cylinder.Radius), high - low)
    return None


def edge_circles(brep):
    circles = []
    for i in range(brep.Edges.Count):
        edge = brep.Edges[i]
        for tol in fit_tolerances():
            try:
                ok, circle = edge.TryGetCircle(tol)
            except Exception:
                break
            if ok and circle is not None and circle.IsValid:
                circles.append(circle)
                break
    return circles


def edge_cylinder(brep):
    circles = edge_circles(brep)
    if len(circles) != 2:
        return None
    tol = tolerance()
    first, second = circles
    if abs(first.Radius - second.Radius) > tol:
        return None
    if not parallel(first.Normal, second.Normal):
        return None
    offset = second.Center - first.Center
    height = offset.Length
    if height <= tol:
        return None
    if not parallel(offset, first.Normal):
        return None
    base = rg.Plane(first.Center, unit(offset))
    return rg.Cylinder(rg.Circle(base, first.Radius), height)


def find_cylinder(brep, face):
    cylinder = analytic_cylinder(face)
    if cylinder is not None:
        return cylinder, "analytic"
    if CYLINDER_FROM_EDGES:
        cylinder = edge_cylinder(brep)
        if cylinder is not None:
            return cylinder, "edges"
    return None, None


def full_revolution(brep, face):
    try:
        srf = face.UnderlyingSurface()
        if srf.IsClosed(0) or srf.IsClosed(1):
            return True
    except Exception:
        pass
    return len(edge_circles(brep)) == 2


def describe(brep, face):
    name = "?"
    closure = "?"
    try:
        srf = face.UnderlyingSurface()
        name = type(srf).__name__
        closure = "closed(u)={} closed(v)={}".format(srf.IsClosed(0), srf.IsClosed(1))
    except Exception:
        pass
    return "surface={} {} circular_edges={} total_edges={}".format(
        name, closure, len(edge_circles(brep)), brep.Edges.Count
    )


# ---------------------------------------------------------------------------
# matching
# ---------------------------------------------------------------------------

def match_sphere(brep):
    if not brep.IsSolid:
        return None, "not a closed solid"
    if brep.Faces.Count != 1:
        return None, "{} faces, a sphere has 1".format(brep.Faces.Count)
    for srf in surfaces_of(brep.Faces[0]):
        for tol in fit_tolerances():
            sphere = try_get(srf, "TryGetSphere", tol)
            if sphere is not None:
                return sphere, "sphere r={:.4g}".format(sphere.Radius)
    return None, "the single face is not spherical"


def cylinder_parts(brep):
    count = brep.Faces.Count
    if count == 1:
        if not ACCEPT_UNCAPPED:
            return None, None, "1 face, a capped cylinder has 3 (ACCEPT_UNCAPPED off)"
        return brep.Faces[0], [], None
    if count != 3:
        return None, None, "{} faces, a capped cylinder has 3".format(count)
    if not brep.IsSolid:
        return None, None, "3 faces but not a closed solid"
    tol = tolerance()
    caps = []
    walls = []
    for i in range(count):
        face = brep.Faces[i]
        (caps if face.IsPlanar(tol) else walls).append(face)
    if len(caps) != 2 or len(walls) != 1:
        return None, None, "{} planar + {} curved faces, expected 2 + 1".format(
            len(caps), len(walls)
        )
    return walls[0], caps, None


def caps_fit(caps, cylinder):
    axis = unit(cylinder.Axis)
    planes = []
    for face in caps:
        plane = face_plane(face)
        if plane is None:
            return "a cap face has no plane"
        if not parallel(plane.Normal, axis):
            return "a cap is not perpendicular to the axis"
        planes.append(plane)
    height = abs(cylinder.Height2 - cylinder.Height1)
    span = abs(dot(planes[1].Origin - planes[0].Origin, axis))
    if abs(span - height) > max(tolerance(), 1e-9):
        return "cap spacing {:.4g} != cylinder height {:.4g}".format(span, height)
    return None


def match_cylinder(brep):
    wall, caps, reason = cylinder_parts(brep)
    if wall is None:
        return None, reason
    cylinder, route = find_cylinder(brep, wall)
    if cylinder is None:
        return None, "the wall face is not a cylinder ({})".format(describe(brep, wall))
    if caps:
        problem = caps_fit(caps, cylinder)
        if problem:
            return None, problem
    elif not full_revolution(brep, wall):
        return None, "the wall face is only a partial revolution"
    height = abs(cylinder.Height2 - cylinder.Height1)
    return cylinder, "cylinder via {} r={:.4g} h={:.4g}".format(route, cylinder.Radius, height)


def match_box(brep):
    if not brep.IsSolid:
        return None, "not a closed solid"
    if brep.Faces.Count != 6:
        return None, "{} faces, a box has 6".format(brep.Faces.Count)
    normals = []
    for i in range(brep.Faces.Count):
        plane = face_plane(brep.Faces[i])
        if plane is None:
            return None, "face {} is not planar".format(i)
        normals.append(unit(plane.Normal))
    axes = []
    for normal in normals:
        aligned = False
        for axis in axes:
            d = abs(dot(axis, normal))
            if d > 1.0 - ANGLE_EPS:
                aligned = True
                break
            if d > ANGLE_EPS:
                return None, "faces are not mutually parallel/perpendicular"
        if not aligned:
            axes.append(normal)
    if len(axes) != 3:
        return None, "normals resolve to {} axes, a box has 3".format(len(axes))
    plane = rg.Plane(rg.Point3d.Origin, axes[0], axes[1])
    if not plane.IsValid:
        return None, "could not build a frame from the face normals"
    try:
        bbox = brep.GetBoundingBox(plane)
    except Exception as e:
        return None, "bounding box failed: {}".format(e)
    if not bbox.IsValid:
        return None, "bounding box is invalid"
    box = rg.Box(
        plane,
        rg.Interval(bbox.Min.X, bbox.Max.X),
        rg.Interval(bbox.Min.Y, bbox.Max.Y),
        rg.Interval(bbox.Min.Z, bbox.Max.Z),
    )
    if not box.IsValid:
        return None, "box is invalid"
    return box, "box"


def tessellate(brep):
    pieces = rg.Mesh.CreateFromBrep(brep, rg.MeshingParameters.Default)
    if not pieces:
        return None
    joined = rg.Mesh()
    for piece in pieces:
        joined.Append(piece)
    joined.Compact()
    return joined


# ---------------------------------------------------------------------------
# COMPAS conversion
# ---------------------------------------------------------------------------

def to_compas_sphere(sphere):
    plane = rg.Plane.WorldXY
    plane.Origin = sphere.Center
    return Sphere(sphere.Radius, frame=plane_to_compas_frame(plane))


def to_compas_cylinder(cylinder):
    """COMPAS puts the cylinder frame at mid-height, Rhino at the base."""
    height = abs(cylinder.Height2 - cylinder.Height1)
    mid = (cylinder.Height1 + cylinder.Height2) / 2.0
    plane = cylinder.CircleAt(mid).Plane
    return Cylinder(cylinder.Radius, height, frame=plane_to_compas_frame(plane))


def to_compas_shape(geo, notes):
    """One piece of RhinoCommon geometry -> (kind, COMPAS shape).

    Raises TypeError, with a message for `summary`, when the geometry cannot
    be handled at all.
    """
    if isinstance(geo, rg.Point3d):
        return "point", point_to_compas(geo)

    if isinstance(geo, rg.Point):
        return "point", point_to_compas(geo.Location)

    if isinstance(geo, rg.PointCloud):
        return "points", [point_to_compas(item.Location) for item in geo]

    if isinstance(geo, rg.Mesh):
        return "mesh", mesh_to_compas(geo)

    if isinstance(geo, rg.Box):
        return "box", box_to_compas(geo)

    if isinstance(geo, rg.BoundingBox):
        return "box", box_to_compas(rg.Box(geo))

    if hasattr(rg, "SubD") and isinstance(geo, rg.SubD):
        mesh = tessellate(geo.ToBrep())
        if mesh is None:
            raise TypeError("SubD could not be tessellated.")
        return "mesh", mesh_to_compas(mesh)

    brep = as_brep(geo)
    if brep is None:
        raise TypeError("unsupported type {}.".format(type(geo).__name__))

    sphere, why_sphere = match_sphere(brep)
    if sphere is not None:
        notes.append("matched {}".format(why_sphere))
        return "sphere", to_compas_sphere(sphere)

    cylinder, why_cylinder = match_cylinder(brep)
    if cylinder is not None:
        notes.append("matched {}".format(why_cylinder))
        return "cylinder", to_compas_cylinder(cylinder)

    box, why_box = match_box(brep)
    if box is not None:
        notes.append("matched {}".format(why_box))
        return "box", box_to_compas(box)

    mesh = tessellate(brep)
    if mesh is None:
        raise TypeError("{} could not be tessellated.".format(type(geo).__name__))
    notes.append(
        "{} ({} faces, solid={}) -> mesh | sphere: {} | cylinder: {} | box: {}".format(
            type(geo).__name__, brep.Faces.Count, brep.IsSolid,
            why_sphere, why_cylinder, why_box,
        )
    )
    return "mesh", mesh_to_compas(mesh)


# ---------------------------------------------------------------------------
# model
# ---------------------------------------------------------------------------

def build_model(items):
    """items: list of (order, kind, shape) in build order -> compas_model Model."""
    model = Model(name=MODEL_NAME)
    for order, kind, shape in items:
        element = model.add_element(Element(name=NAME_FORMAT.format(order)))
        element.treenode.attributes.update(order=order, kind=kind, shape=shape)
    return model


def run_script(geometry: list[object]):
    try:
        items = []
        skipped = []
        reports = []
        counts = {}

        for index, item in enumerate(ensure_list(geometry)):
            geo = unwrap_geometry(item)
            if geo is None:
                skipped.append("[{}] could not be resolved".format(index))
                continue
            notes = []
            try:
                kind, shape = to_compas_shape(geo, notes)
            except TypeError as e:
                skipped.append("[{}] {}".format(index, e))
                continue
            items.append((index, kind, shape))
            counts[kind] = counts.get(kind, 0) + 1
            for note in notes:
                reports.append("[{}] {}".format(index, note))

        model = build_model(items)

        summary = "elements={} ({}) | compas {}".format(
            len(items),
            ", ".join("{}={}".format(k, v) for k, v in sorted(counts.items())) or "none",
            compas.__version__,
        )
        summary += "\norder: " + " ".join(
            "{}:{}".format(order, kind) for order, kind, _ in items
        )
        if skipped:
            summary += "\nskipped {}:\n  {}".format(len(skipped), "\n  ".join(skipped))
        if DIAGNOSTICS and reports:
            summary += "\n" + "\n".join(reports)

        return json_dumps(model), summary

    except Exception as e:
        return None, "Payload build failed: {}: {}".format(type(e).__name__, e)


(payload, summary) = run_script(geometry)
# ---------- end geometry_payload_prep ----------
panel_18 = Panel(geometry_payload_prep.summary)

# ----
# Step 2. Send!
send_to_unity = Button()

# ----
# CAD - Unity
# Communication
panel_19 = Panel("broker.hivemq.com")

qr_code = Plane(PlaneXY(0, 0, 0))
qr_id = Panel("0")
latest_only = BooleanToggle(True)
reset = Button()

# ----
# Send Geometry to Unity
dry_run = BooleanToggle(True)
mqtt_publisher = COMPASEveMQTTPublisher(
    all_geometry=geometry_payload_prep.payload,
    broker=panel_19,
    topic="vicky1",
    codec="proto",
    publish=send_to_unity,
    dry_run=dry_run,
    qr_frames=qr_code,
    qr_ids=qr_id)  # -> success, all_geometry_out, message, all_geometry_json; inputs qr_frames: Plane
# ---------- mqtt_publisher: Python ----------
#! python 3
# venv: venv-compas-xr2.2
# r: compas==2.13.0, compas_model==0.9.3, compas_eve==2.3.0, compas_pb==1.0.0

"""Publish a COMPAS all_geometry to an MQTT broker with compas_eve.

Single responsibility: transport. This component builds no geometry and touches
no disk - it takes a ready all_geometry (the `all_geometry` output of the COMPAS Geometry
all_geometry component, or the `compas_data` output of the file writer) and puts it
on a topic.

The transport is cached in `scriptcontext.sticky` and reused across solves.
MqttTransport connects asynchronously and its publish() defers the actual send
through on_ready, so a transport built and closed inside one solve would tear
down its network loop before the message ever left the process.

Codecs mirror compas_geo_publisher.py: 'json' (COMPAS JSON) and 'protobuf'
(compas_pb binary, what the Unity GeometryPublisher side consumes).

qr_frames (optional, list of Planes or Points): added to the message as
"qr_frames": {"7": Frame, ...}. Plane origin = the printed QR's bottom-left corner,
X = red "X Axis" line, Y = green "Y Axis" line.
qr_ids (optional, list of ints): the QR number of each plane (7 -> QR7 / Tracker_07).
Give every student different numbers. Without it, the list index is used (0, 1, ...).
"""

import time

import Grasshopper
import Rhino.Geometry as rg
import scriptcontext as sc

import compas
import compas_eve as eve
from compas_eve.codecs import JsonMessageCodec
from compas_eve.mqtt import MqttTransport
from compas.data import json_dumps
from compas.data import json_loads
from compas_rhino.conversions import plane_to_compas_frame

STICKY_KEY = "compas_eve.mqtt.transports"
CONNECT_TIMEOUT = 5.0
DEFAULT_PORT = 1883


def require_text(value, label):
    text = str(value).strip() if value is not None else ""
    if not text:
        raise ValueError("{} is required.".format(label))
    return text


def build_codec(name):
    """Return (codec, canonical_name) for a codec input string."""
    key = str(name or "json").strip().lower()
    if key == "json":
        return JsonMessageCodec(), "json"
    if key in ("proto", "protobuf"):
        # Imported lazily so a missing compas_pb only breaks the protobuf path.
        from compas_eve.codecs import ProtobufMessageCodec

        return ProtobufMessageCodec(), "protobuf"
    raise ValueError("Unknown codec {!r}. Use 'json' or 'protobuf'.".format(name))


def get_transport(host, port, codec_name, codec):
    """Connected transport for this endpoint, created once and cached."""
    store = sc.sticky.setdefault(STICKY_KEY, {})
    key = (host, port, codec_name)
    transport = store.get(key)

    if transport is not None:
        if transport.client.is_connected():
            return transport
        # The broker dropped us. Discard the stale one before reconnecting.
        try:
            transport.close()
        except Exception:
            pass
        store.pop(key, None)

    transport = MqttTransport(host, port=port, codec=codec)

    deadline = time.time() + CONNECT_TIMEOUT
    while not transport.client.is_connected() and time.time() < deadline:
        time.sleep(0.05)

    if not transport.client.is_connected():
        transport.close()
        raise RuntimeError(
            "No connection to {}:{} within {:.0f}s.".format(host, port, CONNECT_TIMEOUT)
        )

    store[key] = transport
    return transport


# Bucket per COMPAS kind, matching the original file-based / Unity format.
BUCKETS = {
    "box": "boxes",
    "cylinder": "cylinders",
    "mesh": "meshes",
    "sphere": "spheres",
    "point": "points",
    "points": "points",
}


def model_to_buckets(model):
    """A compas_model Model -> the original Unity dict plus the clicked order.

    Unity's GeometryVisualizer draws dicts of lists of shapes, so the shapes
    go into the usual buckets (boxes, cylinders, meshes, spheres, points).
    `order` lists, in clicked order, where each element landed:
    order[3] == "cylinders[0]" means element 3 is the first cylinder. Unity
    draws that shape at the path "<topic>/cylinders[0]".
    """
    buckets = {name: [] for name in ("boxes", "cylinders", "meshes", "spheres", "points")}
    order = []

    nodes = [element.treenode for element in model.elements()]
    nodes = [n for n in nodes if n is not None and "shape" in n.attributes]
    nodes.sort(key=lambda n: n.attributes.get("order", 0))

    for node in nodes:
        kind = node.attributes.get("kind", "")
        shape = node.attributes["shape"]
        bucket = BUCKETS.get(kind)
        if bucket is None:
            continue
        shapes = shape if isinstance(shape, list) else [shape]
        for item in shapes:
            order.append("{}[{}]".format(bucket, len(buckets[bucket])))
            buckets[bucket].append(item)

    radius = None
    height = None
    if buckets["cylinders"]:
        radius = buckets["cylinders"][0].radius
        height = buckets["cylinders"][0].height
    elif buckets["spheres"]:
        radius = buckets["spheres"][0].radius

    message = dict(buckets)
    message.update({
        "radius": radius,
        "height": height,
        "compas_version": compas.__version__,
        "order": order,
    })
    return message


def stamped(all_geometry):
    """Copy the all_geometry with a fresh `ts`.

    Unity's MqttManager.Msg setter skips an assignment whose value equals the
    previous one, so republishing unchanged geometry would be swallowed on the
    receiving end. A moving field keeps consecutive messages distinct. Same
    workaround as compas_geo_publisher.stamp_all_geometry_ts.

    A compas_model Model is turned into the original bucket dict plus `order`
    (see model_to_buckets).
    """
    if hasattr(all_geometry, "elements") and hasattr(all_geometry, "tree"):
        message = model_to_buckets(all_geometry)
    elif isinstance(all_geometry, dict):
        message = dict(all_geometry)
    else:
        message = {"data": all_geometry}
    message["ts"] = time.time()
    return message


def qr_frame(item):
    """A Plane as is; a point becomes a world-aligned plane at that point (QR flat, X along world X)."""
    if isinstance(item, rg.Point):
        item = item.Location
    if isinstance(item, rg.Point3d):
        item = rg.Plane(item, rg.Vector3d.XAxis, rg.Vector3d.YAxis)
    return plane_to_compas_frame(item)


def close_all():
    """Drop every cached transport. Wired to `disconnect`."""
    store = sc.sticky.get(STICKY_KEY) or {}
    count = len(store)
    for transport in list(store.values()):
        try:
            transport.close()
        except Exception:
            pass
    store.clear()
    return count


def run_script(
    all_geometry,
    broker,
    port,
    topic,
    codec,
    retain,
    publish,
    disconnect,
    dry_run,
    qr_frames,
    qr_ids):

    if disconnect:
        return False, None, "Closed {} cached transport(s).".format(close_all())

    if not publish:
        return False, None, "Press \"Send to Unity\" to send over the Geometry."

    try:
        if all_geometry is None:
            raise ValueError("all_geometry is required.")

        # Check if all_geometry is a list and convert it to a dictionary
        host = require_text(broker, "broker")
        topic_name = require_text(topic, "topic")
        port_number = int(port) if port else DEFAULT_PORT

        codec, codec_name = build_codec(codec)
        transport = get_transport(host, port_number, codec_name, codec)
        time.sleep(0.3)  # temporary — testing a connect/publish race

        publisher = eve.Publisher(eve.Topic(topic_name), transport=transport)
        
        all_geometry = json_loads(all_geometry)
        all_geometry = stamped(all_geometry)
        # After stamped(): the message is always a dict here, even when a Model came in.
        if qr_frames:
            ids = qr_ids or range(len(qr_frames))
            all_geometry["qr_frames"] = {str(int(n)): qr_frame(p) for n, p in zip(ids, qr_frames)}

        if dry_run:
            return True, all_geometry, "[Dry Run]: This all_geometry would be published to {}:{} on '{}'.".format(
                host, port_number, topic_name)

        # Publish the timestamped all_geometry directly
        publisher.publish(all_geometry)
        return True, all_geometry, "Published {} all_geometry to {}:{} on '{}'.".format(
            codec_name, host, port_number, topic_name
        )

    except Exception as e:
        return False, all_geometry, "Publish failed: {}: {}".format(type(e).__name__, e)

(success, all_geometry_out, message) = run_script(all_geometry, broker, port, topic, codec, retain, publish, disconnect, dry_run, qr_frames, qr_ids)
all_geometry_json = json_dumps(all_geometry_out) if all_geometry_out else None
# ---------- end mqtt_publisher ----------
panel_20 = Panel(mqtt_publisher.message)

export = Python3Script(payload=mqtt_publisher.all_geometry_json, path="../Assets/Resources/Samples/brick_wall", write=Toggle(True))  # -> status
# ---------- export: Python ----------
# venv: venv-compas-xr2.2
# r: compas==2.13.0, compas_model==0.9.3, compas_eve==2.3.0, compas_pb==1.0.0
import os

from compas.data import json_loads
from compas_pb import pb_dump_bts


def resolve(path):
    if os.path.isabs(path):
        return path
    gh_file = ghenv.Component.OnPingDocument().FilePath
    if not gh_file:
        raise ValueError("save the .gh file first")
    return os.path.normpath(os.path.join(os.path.dirname(gh_file), path))


def as_data(payload):
    """Accept either JSON text or COMPAS data; return COMPAS data."""
    if isinstance(payload, str):
        text = payload.strip()
        if not text.startswith(("{", "[")):
            raise ValueError(
                "payload arrived as text that is not JSON. It starts with: {!r}. "
                "Wire the publisher's payload_json output into payload.".format(text[:80]))
        return json_loads(text)
    return payload


def run_script(payload, path, write):
    if not write:
        return "idle"
    if not payload:
        return "no payload"

    # Unity reads raw binary TextAssets only with the .bytes extension
    bytes_path = os.path.splitext(resolve(path))[0] + ".bytes"
    json_path = os.path.splitext(resolve(path))[0] + ".json"

    folder = os.path.dirname(bytes_path)
    if folder and not os.path.isdir(folder):
        os.makedirs(folder)

    json = as_data(payload)
    binary = pb_dump_bts(json)
    with open(bytes_path, "wb") as f:
        f.write(binary)

    # with open(json_path, "w", encoding="utf-8") as f:
    #     f.write(payload)

    return "saved {} bytes to {}".format(len(binary), bytes_path)


status = run_script(payload, path, write)
# ---------- end export ----------
panel_21 = Panel(export)
panel_22 = Panel(mqtt_publisher.success)
document_unit = Python3Script()  # -> unit
# ---------- document_unit: Python ----------
import Rhino
import scriptcontext as sc
from Rhino import UnitSystem

def document_unit():
    """The Rhino document's unit system, with a sane fallback."""
    doc = Rhino.RhinoDoc.ActiveDoc
    if doc is None:
        doc = getattr(sc, "doc", None)
    unit = getattr(doc, "ModelUnitSystem", None)
    return unit if unit is not None else UnitSystem.Meters

unit = document_unit()
# ---------- end document_unit ----------
meters = UnitSystem(4)

# ----
# Get updates from Unity
panel_23 = Panel("compasxr/147abhf76tblafjukh/to_rhino")
subscribe = BooleanToggle(True)
auto_update = BooleanToggle(True)
mqtt_subscriber = Python3Script(
    broker=panel_19,
    topic=panel_23,
    codec="proto",
    subscribe=subscribe,
    auto_update=auto_update,
    latest_only=latest_only,
    reset=reset)  # -> success, geometry, data, raw, message
# ---------- mqtt_subscriber: Python ----------
#! python 3
# venv: venv-compas-xr2.2
# r: compas==2.13.0, compas_model==0.9.3, compas_eve==2.3.0, compas_pb==1.0.0

"""Receive COMPAS payloads from an MQTT broker and surface them in Grasshopper.

Mirror image of the publisher component. It reuses the *same* cached
MqttTransport (same STICKY_KEY, same key tuple), so publishing and receiving
share one broker connection.

Threading is the whole design constraint here. compas_eve invokes the callback
on the MQTT network thread; Rhino and Grasshopper objects may only be touched
from the UI thread. So the callback does nothing but append the raw message to
a lock-guarded inbox, and Grasshopper reads that inbox during a normal solve.

Subscriptions are cached per (host, port, codec, topic). Subscribing again on
every solve would stack duplicate callbacks and multiply every message.
"""

import threading
import time
from collections import deque

import Rhino
import scriptcontext as sc

import compas_eve as eve
from compas_eve.codecs import JsonMessageCodec
from compas_eve.mqtt import MqttTransport

from compas.data import Data
from compas.data import json_dumps
from compas.data import json_loads

import compas_rhino.conversions as conversions

STICKY_KEY = "compas_eve.mqtt.transports"  # must match the publisher component
SUBS_KEY = "compas_eve.mqtt.subscriptions"
CONNECT_TIMEOUT = 5.0
DEFAULT_PORT = 1883
INBOX_SIZE = 50


# ---------------------------------------------------------------------------
# transport - identical to the publisher so the cache entry is shared
# ---------------------------------------------------------------------------

def require_text(value, label):
    text = str(value).strip() if value is not None else ""
    if not text:
        raise ValueError("{} is required.".format(label))
    return text


def build_codec(name):
    key = str(name or "json").strip().lower()
    if key == "json":
        return JsonMessageCodec(), "json"
    if key in ("proto", "protobuf"):
        from compas_eve.codecs import ProtobufMessageCodec

        return ProtobufMessageCodec(), "protobuf"
    raise ValueError("Unknown codec {!r}. Use 'json' or 'protobuf'.".format(name))


def get_transport(host, port, codec_name, codec):
    store = sc.sticky.setdefault(STICKY_KEY, {})
    key = (host, port, codec_name)
    transport = store.get(key)

    if transport is not None:
        if transport.client.is_connected():
            return transport, key
        try:
            transport.close()
        except Exception:
            pass
        store.pop(key, None)
        drop_subscriptions_for(key)

    transport = MqttTransport(host, port=port, codec=codec)

    deadline = time.time() + CONNECT_TIMEOUT
    while not transport.client.is_connected() and time.time() < deadline:
        time.sleep(0.05)

    if not transport.client.is_connected():
        transport.close()
        raise RuntimeError(
            "No connection to {}:{} within {:.0f}s.".format(host, port, CONNECT_TIMEOUT)
        )

    store[key] = transport
    return transport, key


# ---------------------------------------------------------------------------
# subscription + inbox
# ---------------------------------------------------------------------------

def request_solution(component):
    """Ask Grasshopper to recompute, called from the MQTT thread.

    ExpireSolution has to run on the UI thread, so it is marshalled across with
    InvokeOnUiThread. Failure here is cosmetic: the message is already in the
    inbox and any manual recompute will pick it up.
    """
    if component is None:
        return

    def expire():
        try:
            if component.OnPingDocument() is not None:
                component.ExpireSolution(True)
        except Exception:
            pass

    try:
        import System

        Rhino.RhinoApp.InvokeOnUiThread(System.Action(expire))
    except Exception:
        pass


def ensure_subscription(transport, transport_key, topic_name, component, auto_update):
    """Subscribe once per endpoint+topic and return the inbox for it."""
    store = sc.sticky.setdefault(SUBS_KEY, {})
    sub_key = transport_key + (topic_name,)

    entry = store.get(sub_key)
    if entry is not None:
        entry["component"] = component if auto_update else None
        return entry

    entry = {
        "lock": threading.Lock(),
        "messages": deque(maxlen=INBOX_SIZE),
        "count": 0,
        "component": component if auto_update else None,
        "subscriber": None,
    }

    def on_message(message):
        # MQTT network thread. Do not touch Rhino or Grasshopper from here.
        with entry["lock"]:
            entry["messages"].append(message)
            entry["count"] += 1
        request_solution(entry["component"])

    subscriber = eve.Subscriber(
        eve.Topic(topic_name), callback=on_message, transport=transport
    )
    subscriber.subscribe()

    entry["subscriber"] = subscriber
    store[sub_key] = entry
    return entry


def drop_subscriptions_for(transport_key):
    """Forget subscriptions bound to a transport that has gone away."""
    store = sc.sticky.get(SUBS_KEY) or {}
    for sub_key in [k for k in store if k[: len(transport_key)] == transport_key]:
        entry = store.pop(sub_key)
        try:
            entry["subscriber"].unsubscribe()
        except Exception:
            pass


def unsubscribe_all():
    store = sc.sticky.get(SUBS_KEY) or {}
    count = len(store)
    for entry in list(store.values()):
        try:
            entry["subscriber"].unsubscribe()
        except Exception:
            pass
    store.clear()
    return count


# ---------------------------------------------------------------------------
# payload -> COMPAS -> Rhino
# ---------------------------------------------------------------------------

def rehydrate(message):
    """Rebuild COMPAS objects from a decoded message.

    Depending on the codec you may already get real COMPAS objects back. If you
    get plain dicts carrying `dtype`/`value`, a round trip through the COMPAS
    encoder reconstructs them. Anything that will not round trip is returned
    untouched.
    """
    try:
        return json_loads(json_dumps(message))
    except Exception:
        return message


def collect_data(value, found, depth=0):
    """Walk a nested payload and pull out every COMPAS Data instance."""
    if depth > 8:
        return found
    if isinstance(value, Data):
        found.append(value)
    elif isinstance(value, dict):
        for item in value.values():
            collect_data(item, found, depth + 1)
    elif isinstance(value, (list, tuple)):
        for item in value:
            collect_data(item, found, depth + 1)
    return found


# Ordered because subclasses have to be tested before their bases.
def converter_table():
    from compas.datastructures import Mesh
    from compas.geometry import (
        Box,
        Circle,
        Cone,
        Cylinder,
        Ellipse,
        Frame,
        Line,
        Plane,
        Point,
        Polygon,
        Polyline,
        Sphere,
        Torus,
        Vector,
    )

    return [
        (Mesh, conversions.mesh_to_rhino),
        (Polyline, conversions.polyline_to_rhino),
        (Polygon, conversions.polygon_to_rhino),
        (Line, conversions.line_to_rhino),
        (Circle, conversions.circle_to_rhino),
        (Ellipse, conversions.ellipse_to_rhino),
        (Box, conversions.box_to_rhino),
        (Sphere, conversions.sphere_to_rhino),
        (Cylinder, conversions.cylinder_to_rhino),
        (Cone, conversions.cone_to_rhino),
        (Torus, conversions.torus_to_rhino),
        (Frame, conversions.frame_to_rhino),
        (Plane, conversions.plane_to_rhino),
        (Point, conversions.point_to_rhino),
        (Vector, conversions.vector_to_rhino),
    ]


def to_rhino(obj, table):
    """Best-effort conversion. Returns None for types not in the table."""
    native = getattr(obj, "to_rhino", None)
    if callable(native):
        try:
            return native()
        except Exception:
            pass
    for cls, fn in table:
        if isinstance(obj, cls):
            try:
                return fn(obj)
            except Exception:
                return None
    return None


# ---------------------------------------------------------------------------

def run_script(broker, port, topic, codec, subscribe, auto_update, latest_only, reset):
    if reset:
        return False, [], [], [], "Unsubscribed from {} topic(s).".format(unsubscribe_all())

    if not subscribe:
        return False, [], [], [], "Set subscribe = True to start listening."

    try:
        host = require_text(broker, "broker")
        topic_name = require_text(topic, "topic")
        port_number = int(port) if port else DEFAULT_PORT

        codec_obj, codec_name = build_codec(codec)
        transport, transport_key = get_transport(host, port_number, codec_name, codec_obj)

        component = ghenv.Component  # noqa: F821 - injected by the GH script editor
        entry = ensure_subscription(
            transport, transport_key, topic_name, component, bool(auto_update)
        )

        with entry["lock"]:
            raw = list(entry["messages"])
            total = entry["count"]

        if latest_only and raw:
            raw = raw[-1:]

        if not raw:
            return True, [], [], [], "Listening on '{}' at {}:{}. Nothing received yet.".format(
                topic_name, host, port_number
            )

        table = converter_table()
        data = []
        geometry = []
        unconverted = 0

        for message in raw:
            for obj in collect_data(rehydrate(message), []):
                data.append(obj)
                native = to_rhino(obj, table)
                if native is None:
                    unconverted += 1
                else:
                    geometry.append(native)

        note = ""
        if unconverted:
            note = " {} object(s) had no Rhino converter - see the `data` output.".format(
                unconverted
            )

        return (
            True,
            geometry,
            data,
            raw,
            "{} message(s) held, {} received in total.{}".format(len(raw), total, note),
        )

    except Exception as e:
        return False, [], [], [], "Subscribe failed: {}: {}".format(type(e).__name__, e)


(success, geometry, data, raw, message) = run_script(
    broker, port, topic, codec, subscribe, auto_update, latest_only, reset
)
# ---------- end mqtt_subscriber ----------
panel_24 = Panel(mqtt_subscriber.message)
panel_25 = Panel(mqtt_subscriber.success)
convert_units = ConvertUnits(Data=mqtt_subscriber.geometry, Source=meters, Target=document_unit)

# ----
# Visualize Incoming Geometry
number_slider_8 = Slider(100, range=0..100)
transparency = Slider(0, range=0..1)
create_material = CreateMaterial(
    Diffuse=ColourSwatch(SwatchColor=RGB(23, 130, 119)),
    Specular=RGB(255, 255, 255),
    Emission=RGB(0, 0, 0),
    Transparency=transparency,
    Shine=number_slider_8)
custom_preview = CustomPreview(Geometry=mqtt_subscriber.geometry, Material=create_material)

custom_preview_2 = CustomPreview(Geometry=geometry_2, Material=create_material)
